vi "Main.gvi"   [LabVIEW NXG 5.0.0]
# This template is for the Queued Message Handler design pattern.
# The Event Handling Loop generates messages based on user interface actions.
# The Message Handling Loop processes messages generated by the Event Handling Loop, or by other messages.  The messages are string values, so new messages can be added easily to the Message Cases case structure in the Message Handling Loop.  Each message cluster can also provide an optional value for Message Data, which is a variant that can be converted to whatever message-specific data is required.
panel controls:
  "Exit": bool
  "TEMP Button": bool
  "LUX Button": bool
  "VISA Resource Name": "VISA Instr" = "COM5"
  "Initialize VISA": bool
  "CMD Button": bool
  "Initialize AI": bool
  "Panel Config Button": bool
  "Set PV Angle Button": bool
  "IR Thermometer Position": bool
  "Fans Button": bool
  "Brightness Config Button": bool
  "Optic Filter Config Button": bool
  "Reset CVM Button": bool
  "Stop": bool
  "Panel Config Selector": string
  "PV Angle": i32
  "Fans Selector": string
  "Optic Filter Selector": string
  "IR Thermometer Position Selector": string
  "Brightness": i32
  "Prepare CVM": bool
  "Command to Arduino": string = "@DO 34 0#"
  "Set LoadR": bool
  "No Load": bool
  "Set LoadRTotal": string
  "VAC Button": bool
  "Heat Selector": string
  "Heat Button": bool
  "Exit 2": bool
  "Do Something": bool
  "Do Something Else": bool
  "Tab": i32
  "LoadR1": string
  "LoadR10": string
  "LoadR100": string
  "LoadR1000": string
  "Measured Data": "Measured Data.gtype"
  "Receive MV": bool
panel indicators:
  "Display": string
  "Command reply": "ArduinoReply.gtype"
  "LUXSensor Reply": "ArduinoReply.gtype"
  "TempSensor Reply": "ArduinoReply.gtype"
  "AI measurements": waveform<f64>[]
  "Hardware Current Status": string
  "V Coeff": f64
  "C Coeff": f64
  "Recalculated Voltage": f64
  "Recalculated Current": f64
  "VAC Load Counter": i32
  "Voltage_Graph": f64[]
  "VISA Answer_2": "ArduinoReply.gtype"[]
  "Current_Graph": f64[]
  "VAC": cluster{"Element 1": f64[], "Element 2": f64[]}
  "PV-Connecting Solar Panels": string
  "MV-Panel Configuration": string
  "MV-Cooling": string
  "MV-Heating": string
  "MV-Optical Filter": string
  "MV-Panel Tilt Angle": string
  "MV-Light Power": string
  "MV-LoadR1": string
  "MV-LoadR2": string
  "MV-LoadR3": string
  "MV-LoadR4": string
  "API Key": string
  "Server URL": string
  "Status of Send to SystemLink Cycle": string
  "PV-Current, mA": f64
  "SendDoubleToCloud": string
  "PV-LoadR,Ohm": f64
  "PV-Voltage, V": f64
  "PV-Temperature, ºC": f64
  "PV-LightIntensity, W/m2": f64
  "PV-Panel Tilt Angle, º": f64
  "PV-Panel Cofiguration": string
  "SendStringToCloud": string
  "PV-Cooling": string
  "PV-Heating": string
  "PV-Optical Filter": string
  "PV-LoadR1": string
  "PV-LoadR2": string
  "PV-LoadR3": string
  "PV-LoadR4": string
  "Error out Systemlink Read Cycle": error
  "Voltage MidPoint": f64
  "Current MidPoint": f64
  "Arduino Status": string
  "SendArrayDoubleToCloud": string
  "TempSensor": f64
  "LuxSensor": f64
  "LuxSensor Error": string
  "Total Set LoadR": i32
  "TempSensor Error": string
  "MV-LoadRTotal": string
  "Voltage EndPoint": f64
  "Current EndPoint": f64
  "TempSensor IR": f64
  "PV-LoadRTotal": string
  "PV-Temperature IR Position": string
  "PV-LigthPower, %": f64
  "PV-Temperature IR, ºC": f64
  "Total LoadR_SET": string
types:
  "ArduinoReply.gtype" = cluster{"Timestamp": timestamp, "DATA": string}
  "Measured Data.gtype" = cluster{"Voltage, V": f64, "Current, mA": f64, "Luminous Flux, Lux": f64, "Temperature, GradC": f64, "Temperature IR, GradC": f64}
  T1 = cluster{"VISA Resource": "VISA Instr", "Physical Channel": "DAQmx Task"}
  "UI Data.gtype" = cluster{"Boolean": bool, "String": string, "Numeric": f64}
  "ValueRange.gtype" = cluster{"maximum value": f64, "minimum value": f64}
uses:
  NI::Skyline::Configuration::Open Configuration API Key.gvi
  NI::Skyline::TagHTTP::Query Tags.gvi
  NI::Skyline::TagHTTP::Open Tag.gvi
  NI::Skyline::TagHTTP::Read Tag (String).gvi
  NI::Skyline::TagHTTP::Close Tag (Single).gvi
  NI::Skyline::Configuration::Close Configuration.gvi
  Message Queue::Create All Message Queues.gvi
  Message Queue::Enqueue Message (Single).gvi
  Support::Error Handler - Event Handling Loop.gvi
  Message Queue::Dequeue Message.gvi
  NI::VISA::Configure Serial Port (Instr).gvi
  NI::VISA::Open (Instr).gvi
  NI::DAQmx::Internal::DAQmx Create Channel (AI-Voltage-Basic).gvi
  Queued Message Handler::VISA ReadWrite.gvi
  Queued Message Handler::VISA Reply Parse.gvi
  NI::DAQmx::Internal::DAQmx Read (Analog 2D DBL NChan NSamp).gvi
  NI::DAQmx::Internal::DAQmx Read (Analog 1D Wfm NChan NSamp).gvi
  Queued Message Handler::Panel Switch.gvi
  Queued Message Handler::VISA Multiple Write.gvi
  NI::G Core::Error::Display Error.gvi
  NI::DAQmx::Internal::DAQmx Stop Task.gvi
  NI::VISA::Close (Instr).gvi
  NI::G Core::Error::Build Error Cluster.gvi
  Support::Error Handler - Message Handling Loop.gvi
  NI::Skyline::TagHTTP::Write Tag (DBL).gvi
  NI::Skyline::TagHTTP::Write Tag (String).gvi
  NI::Vision::IMAQdx::Initialize.gvi
  NI::Vision::IMAQdx::Configure Grab.gvi
  NI::Vision::Core::Basics::Create Image.gvi
  NI::Vision::IMAQdx::Grab.gvi
  NI::Vision::IMAQdx::Close.gvi
diagram:
  $"MV-Panel Configuration" <- ""
  $"MV-Cooling" <- ""
  $"MV-Heating" <- ""
  $"MV-Optical Filter" <- ""
  $"MV-Panel Tilt Angle" <- ""
  $"MV-Light Power" <- ""
  $"MV-LoadR1" <- ""
  $"MV-LoadR2" <- ""
  $"MV-LoadR3" <- ""
  $"MV-LoadR4" <- ""
  $"MV-LoadRTotal" <- ""
  # PV Config
  # 	Single
  # 	Parallel 2
  # 	Parallel 2 Diode
  # 	Series 2
  # 	Series 2 Diode
  # 	Parallel 4
  # 	Parallel 4 Diode
  # 	Series 4
  # 	Series 4 Diode
  # 	Parallel Of Series
  # 	Parallel Of Series Diode
  # 	Series Of Parallel
  # 	Series Of Parallel Diode
  # Optic Filter Config
  # 	No Filter
  # 	Filter 1
  # 	Filter 2
  # IR Thermomether
  # 	None
  # 	Panel 1
  # 	Panel 2
  # 	Panel 3
  # 	Panel 4
  # Heating/Cooling
  # 	0
  # 	50
  # 	100
  # Light Power
  # 	0 ... 100
  # Panel Tilt Angle
  # 	0 ... 120
  # Load 1
  # Load 2
  # Load 3
  # Load 4
  w1 = ["MV-Panels Configuration", "MV-Cooling", "MV-Heating", "MV-Optical Filter", "MV-Panel Tilt Angle", "MV-Light Power", "MV-LoadR1", "MV-LoadR2", "MV-LoadR3", "MV-LoadR4", "MV-LoadRTotal"]
  Array Size(array=w1) -> (size(s)=w2)
  Initialize Array(element=1904-12-31T23:00:00Z, size=w2) -> w3
  sequence {
    frame 0 {
      Wait(time to wait=20000)
    }
  }
  s1 = w3  # shift register
  while {
    Wait(time to wait=500)
    case ($"Receive MV") {
      frame False, Default {
        w4 = s1
      }
      frame True {
        call "Open Configuration API Key.gvi"(server url=$"Server URL", api key=$"API Key") -> (configuration=w5, error out=w6)
        call "Query Tags.gvi"(paths=w1, error in=w6, configuration=w5) -> (tags=w7, error out=w8)
        Build Array(reference to "MV-Panel Configuration", reference to "MV-Cooling", reference to "MV-Heating", reference to "MV-Optical Filter", reference to "MV-Panel Tilt Angle", reference to "MV-Light Power", reference to "MV-LoadR1", reference to "MV-LoadR2", reference to "MV-LoadR3", reference to "MV-LoadR4", reference to "MV-LoadRTotal") -> w9
        for {
          w10 = each element of w7
          w11 = each element of s1
          w12 = each element of w9
          Property Node(instance in=w10) -> ("Path"=w13, "Datatype"=w14)
          call "Open Tag.gvi"(path=w13, data type=w14, error in=w8, configuration=w5) -> (tag=w15, error out=w16)
          call "Read Tag (String).gvi"(tag in=w15, error in=w16) -> (value=w17, time stamp=w18, error out=w19)
          Is Greater(x=w18, y=w11) -> w20
          case (w20) {
            frame False, Default { }
            frame True {
              Property Node(instance in=w12, "ValueSignaling"=w17)
            }
          }
          append w18 to w4
        }
        for {
          w21 = each element of w7
          call "Close Tag (Single).gvi"(tag=w21, error in=w19) -> (error out=w22)
        }
        call "Close Configuration.gvi"(configuration=w5, error in=w22) -> (error out=w23)
        $"Error out Systemlink Read Cycle" <- w23
      }
    }
    next s1 = w4
    stop if $"Exit 2"
  }
  $"PV-Connecting Solar Panels" <- ""
  disable {
    frame Enabled { }
    frame Disabled {
      Destroy User Event()
    }
  }
  w24 = bool FALSE  # Stop Event
  Create User Event[EventName="Stop Event"](user event data type=w24) -> (error out=w25, user event out=w26)
  Register For Events("Stop Event"=w26) -> (event registration refnum out=w27)
  call "Create All Message Queues.gvi"(error in=w25) -> (message queues=w28, error out=w29)
  Property Node(instance in=w28) -> ("UI"=w30)
  s2 = w27  # shift register
  while {
    event (dynamic events = s2) {
      on "Exit" Value changed {
        call "Enqueue Message (Single).gvi"(priority message=TRUE, message queue in=w30, message="Exit") -> (message queue out=w33, error out=w32)
        w31 = default
      }
      on dynamic event 0 {
        $Display <- "\"Exit\" button pressed"
        w31 = TRUE
        w32 = default
        w33 = w30
      }
      on "Window" Close? {
        call "Enqueue Message (Single).gvi"(priority message=TRUE, message queue in=w30, message="Exit") -> (message queue out=w33)
        Event Filter("Discard?"=TRUE)
        w31 = default
        w32 = default
      }
      on "Initialize VISA" Value changed {
        call "Enqueue Message (Single).gvi"(message queue in=w30, message="Initialize VISA") -> (message queue out=w33, error out=w32)
        w31 = default
      }
      on "Initialize AI" Value changed {
        call "Enqueue Message (Single).gvi"(message queue in=w30, message="Initialize AI") -> (message queue out=w33, error out=w32)
        w31 = default
      }
      on "CMD Button" Value changed {
        call "Enqueue Message (Single).gvi"(message queue in=w30, message="Send CMD") -> (message queue out=w33, error out=w32)
        w31 = default
      }
      on "TEMP Button" Value changed {
        call "Enqueue Message (Single).gvi"(message queue in=w30, message="Get Temperature") -> (message queue out=w33, error out=w32)
        w31 = default
      }
      on "LUX Button" Value changed {
        call "Enqueue Message (Single).gvi"(message queue in=w30, message="Get Brightness") -> (message queue out=w33, error out=w32)
        w31 = default
      }
      on "Reset CVM Button" Value changed {
        call "Enqueue Message (Single).gvi"(message queue in=w30, message="Reset CVM") -> (message queue out=w33, error out=w32)
        w31 = default
      }
      on "Panel Config Button" Value changed {
        call "Enqueue Message (Single).gvi"(message queue in=w30, message="Panel Config", message data=$"Panel Config Selector") -> (message queue out=w33, error out=w32)
        w31 = default
      }
      on "MV-Panel Configuration" Value changed {
        Event Data() -> ("New Value"=w34)
        call "Enqueue Message (Single).gvi"(message queue in=w30, message="PV Config", message data=w34) -> (message queue out=w33, error out=w32)
        w31 = default
      }
      on "Heat Button" Value changed {
        call "Enqueue Message (Single).gvi"(message queue in=w30, message="Heat Config", message data=$"Heat Selector") -> (message queue out=w33, error out=w32)
        w31 = default
      }
      on "MV-Heating" Value changed {
        Event Data() -> ("New Value"=w35)
        call "Enqueue Message (Single).gvi"(message queue in=w30, message="Heat Config", message data=w35) -> (message queue out=w33, error out=w32)
        w31 = default
      }
      on "Set PV Angle Button" Value changed {
        call "Enqueue Message (Single).gvi"(message queue in=w30, message="Set PV Angle", message data=$"PV Angle") -> (message queue out=w33, error out=w32)
        w31 = default
      }
      on "MV-Panel Tilt Angle" Value changed {
        Event Data() -> ("New Value"=w36)
        Decimal String To Number(string=w36) -> (offset past number=w37)
        call "Enqueue Message (Single).gvi"(message queue in=w30, message="Set PV Angle", message data=w37) -> (message queue out=w33, error out=w32)
        w31 = default
      }
      on "IR Thermometer Position" Value changed {
        call "Enqueue Message (Single).gvi"(message queue in=w30, message="IR Thermometer Position", message data=$"IR Thermometer Position Selector") -> (message queue out=w33, error out=w32)
        w31 = default
      }
      on "Fans Button" Value changed {
        call "Enqueue Message (Single).gvi"(message queue in=w30, message="Fans Control", message data=$"Fans Selector") -> (message queue out=w33, error out=w32)
        w31 = default
      }
      on "MV-Cooling" Value changed {
        Event Data() -> ("New Value"=w38)
        call "Enqueue Message (Single).gvi"(message queue in=w30, message="Fans Control", message data=w38) -> (message queue out=w33, error out=w32)
        w31 = default
      }
      on "Brightness Config Button" Value changed {
        call "Enqueue Message (Single).gvi"(message queue in=w30, message="Brightness Config", message data=$Brightness) -> (message queue out=w33, error out=w32)
        w31 = default
      }
      on "MV-Light Power" Value changed {
        Event Data() -> ("New Value"=w39)
        call "Enqueue Message (Single).gvi"(message queue in=w30, message="Brightness Config", message data=w39) -> (message queue out=w33, error out=w32)
        w31 = default
      }
      on "Optic Filter Config Button" Value changed {
        call "Enqueue Message (Single).gvi"(message queue in=w30, message="Optic Filter Config", message data=$"Optic Filter Selector") -> (message queue out=w33, error out=w32)
        w31 = default
      }
      on "MV-Optical Filter" Value changed {
        Event Data() -> ("New Value"=w40)
        call "Enqueue Message (Single).gvi"(message queue in=w30, message="Optic Filter Config", message data=w40) -> (message queue out=w33, error out=w32)
        w31 = default
      }
      on "Prepare CVM" Value changed {
        call "Enqueue Message (Single).gvi"(message queue in=w30, message="Prepare CVM") -> (message queue out=w33, error out=w32)
        w31 = default
      }
      on "Set LoadR" Value changed {
        Concatenate Strings($LoadR1, $LoadR10, $LoadR100, $LoadR1000) -> w41
        Is Empty String Or Path(string/path=$"Set LoadRTotal") -> w42
        Select(s=w42, t=w41, f=$"Set LoadRTotal") -> w43
        call "Enqueue Message (Single).gvi"(message queue in=w30, message="Set LoadR", message data=w43) -> (message queue out=w33, error out=w32)
        w31 = default
      }
      on "MV-LoadRTotal" Value changed {
        Concatenate Strings($LoadR1, $LoadR10, $LoadR100, $LoadR1000) -> w44
        call "Enqueue Message (Single).gvi"(message queue in=w30, message="Set LoadR", message data=w44) -> (message queue out=w33, error out=w32)
        w31 = default
      }
      on "No Load" Value changed {
        call "Enqueue Message (Single).gvi"(message queue in=w30, message="NoLoad") -> (message queue out=w33, error out=w32)
        w31 = default
      }
      on "VAC Button" Value changed {
        Property Node(instance in=reference to "VAC")
        Get Current Time() -> (current time=w45)
        call "Enqueue Message (Single).gvi"(message queue in=w30, message="VAC", message data=w45) -> (message queue out=w33)
        $"VAC Load Counter" <- 0
        w31 = default
        w32 = default
      }
    }
    call "Error Handler - Event Handling Loop.gvi"(message queue in=w33, error in=w32) -> (dup error in=w46)
    stop if w31
  }
  Unregister For Events(error in=w46, event registration refnum=s2)
  $"API Key" <- "zYUbuW0YNkg1G__lXfJiGVBNWME-HlVd2a5NUHp-IP"
  s3 = "UI Data.gtype" {all zero or empty}  # shift register
  s4 = T1 {"VISA Resource"="COM5", "Physical Channel"=""}  # shift register
  while {
    call "Dequeue Message.gvi"(message queue in=w30, error in=w29) -> (message queue out=w47, message=w48, message data=w49, error out=w50)
    $"Hardware Current Status" <- w48
    # s3: Data
    # s4: VISA
    # w26: Stop Event
    case (w48) ignore case {  # Message Cases
      frame "Initialize" {
        call "Enqueue Message (Single).gvi"(message queue in=w47, message="Initialize VISA", error in=w50) -> (message queue out=w55, error out=w56)
        call "Enqueue Message (Single).gvi"(message queue in=w55, message="Initialize AI", error in=w56) -> (message queue out=w57, error out=w58)
        call "Enqueue Message (Single).gvi"(message queue in=w57, message="Set Arduino Status", error in=w58) -> (message queue out=w59, error out=w60)
        call "Enqueue Message (Single).gvi"(message queue in=w59, message="Reset CVM", error in=w60) -> (message queue out=w61, error out=w62)
        call "Enqueue Message (Single).gvi"(message queue in=w61, message="NoLoad", error in=w62) -> (message queue out=w63, error out=w64)
        call "Enqueue Message (Single).gvi"(message queue in=w63, message="Brightness Config", message data=2, error in=w64) -> (message queue out=w65, error out=w66)
        call "Enqueue Message (Single).gvi"(message queue in=w65, message="Fans Control", message data="0", error in=w66) -> (message queue out=w67, error out=w68)
        call "Enqueue Message (Single).gvi"(message queue in=w67, message="Heat Config", message data="0", error in=w68) -> (message queue out=w69, error out=w70)
        call "Enqueue Message (Single).gvi"(message queue in=w69, message="Optic Filter Config", message data="No Filter", error in=w70) -> (message queue out=w71, error out=w72)
        call "Enqueue Message (Single).gvi"(message queue in=w71, message="IR Thermometer Position", message data="None", error in=w72) -> (message queue out=w73, error out=w74)
        call "Enqueue Message (Single).gvi"(message queue in=w73, message="Set PV Angle", message data=90, error in=w74) -> (message queue out=w75, error out=w76)
        call "Enqueue Message (Single).gvi"(message queue in=w75, message="Panel Config", message data="Parallel 4", error in=w76) -> (message queue out=w77, error out=w78)
        call "Enqueue Message (Single).gvi"(message queue in=w77, message="Wait For Event", error in=w78) -> (error out=w51)
        Build Array(reference to "Arduino Status", reference to "TempSensor Error", reference to "LuxSensor Error", reference to "Set LoadRTotal") -> w79
        for {
          w80 = each element of w79
          Property Node(instance in=w80, "Value"="none")
        }
        Build Array(reference to "TempSensor", reference to "LuxSensor", reference to "Recalculated Voltage", reference to "Voltage EndPoint", reference to "Voltage MidPoint", reference to "Recalculated Current", reference to "Current EndPoint", reference to "Current MidPoint", reference to "V Coeff", reference to "C Coeff") -> w81
        for {
          w82 = each element of w81
          Property Node(instance in=w82, "Value"=-1)
        }
        w52 = s3
        w53 = default
        w54 = s4
      }
      frame "Initialize VISA" {
        call "Configure Serial Port (Instr).gvi"(stop bits="1.0"(10), session in=$"VISA Resource Name", error in=w50, baud rate=115200, parity="None"(0), termination char=0xA, enable termination char=TRUE) -> (session out=w83, error out=w84)
        call "Open (Instr).gvi"(resource name=w83, error in=w84) -> (session out=w85, error out=w51)
        Property Node(instance in=s4, "VISA Resource"=w85) -> (instance out=w54)
        Wait(time to wait=2000)
        w52 = s3
        w53 = default
      }
      frame "Initialize AI" {
        call "DAQmx Create Channel (AI-Voltage-Basic).gvi"(error in=w50, physical channels="Dev1/ai0:1,Dev1/ai3,Dev1/ai7", units="Volts"(10348), measurement range="ValueRange.gtype" {"maximum value"=10, "minimum value"=0}, input terminal configuration="RSE"(10083)) -> (task out=w86, error out=w51)
        Property Node(instance in=s4, "Physical Channel"=w86) -> (instance out=w54)
        w52 = s3
        w53 = default
      }
      frame "Wait For Event" {
        Wait(time to wait=100)
        call "Enqueue Message (Single).gvi"(message queue in=w47, message="Watchdog", error in=w50) -> (error out=w51)
        w52 = s3
        w53 = default
        w54 = s4
      }
      frame "Send CMD" {
        Property Node(instance in=s4) -> ("VISA Resource"=w87, instance out=w54)
        call "Enqueue Message (Single).gvi"(message queue in=w47, message="Wait For Event", error in=w50) -> (error out=w88)
        call "VISA ReadWrite.gvi"(VISA_IN=w87, CMD=$"Command to Arduino", ERROR_IN=w88) -> (Arduino_Reply=w89, ERROR_OUT=w51)
        $"Command reply" <- w89
        w52 = s3
        w53 = default
      }
      frame "Set Arduino Status" {
        Property Node(instance in=s4) -> ("VISA Resource"=w90, instance out=w54)
        call "VISA ReadWrite.gvi"(VISA_IN=w90, CMD="@TIME 10 CEPHEI#", ERROR_IN=w50) -> (ERROR_OUT=w51)
        w52 = s3
        w53 = default
      }
      frame "Watchdog" {
        Property Node(instance in=s4) -> ("Physical Channel"=w91, "VISA Resource"=w92, instance out=w54)
        call "VISA ReadWrite.gvi"(VISA_IN=w92, CMD="@TIME 10 ?#", ERROR_IN=w50) -> (OUTPUT=w93, Arduino_Reply=w94, ERROR_OUT=w95)
        Property Node(instance in=w94) -> ("DATA"=w96)
        call "VISA Reply Parse.gvi"(string=w96) -> (Reply String=w97)
        Match Pattern(regular expression="CEPHEI", string=w97) -> (match substring=w98)
        Is Equal(x=w98, y="CEPHEI") -> w99
        case (w99) {
          frame False, Default {
            call "Enqueue Message (Single).gvi"(message queue in=w47, message="Initialize", error in=w95) -> (error out=w51)
          }
          frame True {
            call "VISA ReadWrite.gvi"(VISA_IN=w93, CMD="@LUX 10 1#", ERROR_IN=w95) -> (OUTPUT=w100, Arduino_Reply=w101, ERROR_OUT=w102)
            call "VISA ReadWrite.gvi"(VISA_IN=w100, CMD="@TEMP 8 0#", ERROR_IN=w102) -> (Arduino_Reply=w103, ERROR_OUT=w104)
            call "DAQmx Read (Analog 2D DBL NChan NSamp).gvi"(task in=w91, error in=w104, number of samples per channel=1) -> (error out=w105, data=w106)
            Array Index(array=w106) -> (out0[1, 0]=w107, out1[2, 0]=w108)
            Multiply(w107, 4) -> w109
            Multiply(w109, $"V Coeff") -> w110
            Feedback Node(input=w111) -> w112
            Build Array(w112, w110) -> w111
            $Voltage_Graph <- w111
            $"Recalculated Voltage" <- w110
            $"Voltage EndPoint" <- w107
            $"Voltage MidPoint" <- w108
            Array Index(array=w106) -> (out0[0, 0]=w113, out1[3, 0]=w114)
            Divide(x=w113, y=70) -> w115
            Multiply(w115, 1000) -> w116
            Multiply(w116, $"C Coeff") -> w117
            Feedback Node(input=w118) -> w119
            Build Array(w119, w117) -> w118
            $Current_Graph <- w118
            $"Recalculated Current" <- w117
            $"Current EndPoint" <- w113
            $"Current MidPoint" <- w114
            call "DAQmx Read (Analog 1D Wfm NChan NSamp).gvi"(task in=w91, error in=w105, number of samples per channel=1) -> (error out=w120, data=w121)
            call "Enqueue Message (Single).gvi"(message queue in=w47, message="Wait For Event", error in=w120) -> (error out=w51)
            $"AI measurements" <- w121
            Property Node(instance in=reference to "PV-Current, mA", "Value"=w117)
            Property Node(instance in=w101) -> ("DATA"=w122, instance out=w123)
            $"LUXSensor Reply" <- w123
            Property Node(instance in=w103) -> ("DATA"=w124, instance out=w125)
            $"TempSensor Reply" <- w125
            Property Node(instance in=reference to "PV-Voltage, V", "Value"=w110)
            call "VISA Reply Parse.gvi"(string=w122) -> (Error code=w126, Reply=w127)
            Property Node(instance in=reference to "PV-LightIntensity, W/m2", "Value"=w127)
            call "VISA Reply Parse.gvi"(string=w124) -> (Error code=w128, Reply=w129)
            Property Node(instance in=$"Measured Data", "Voltage, V"=w110, "Current, mA"=w117, "Luminous Flux, Lux"=w127, "Temperature, GradC"=w129, "Temperature IR, GradC"=0) -> (instance out=w130)
            $"Measured Data" <- w130
            $"LuxSensor Error" <- w126
            $"TempSensor Error" <- w128
            Property Node(instance in=reference to "PV-Temperature, ºC", "Value"=w129)
            $LuxSensor <- w127
            $TempSensor <- w129
          }
        }
        $"Arduino Status" <- w97
        w52 = s3
        w53 = default
      }
      frame "Panel Config" {
        Property Node(instance in=s4) -> ("VISA Resource"=w131, instance out=w54)
        Variant To Data(error in (no error)=w50, type=string "", variant=w49) -> (data=w132, error out=w133)
        call "Panel Switch.gvi"(VISA_IN=w131, CTRL="Disconnect", ERROR_IN=w133) -> (VISA_OUT=w134, ERROR_OUT=w135)
        case (w132) {
          frame "Single" {
            w138 = ["@DO 17 0#", "@DO 18 1#", "@DO 23 1#", "@DO 24 1#", "@DO 25 1#", "@DO 26 0#", "@DO 27 0#", "@DO 28 0#", "@DO 29 1#", "@DO 30 1#", "@DO 31 1#", "@DO 32 1#", "@DO 33 0#"]
            w139 = ["@DO 54 1#", "@DO 55 1#", "@DO 56 1#", "@DO 57 1#", "@DO 58 1#", "@DO 59 1#", "@DO 60 1#", "@DO 61 1#"]
            # @DO 17 0#
            # @DO 18 1#
            # @DO 23 1#
            # @DO 24 1#
            # @DO 25 1#
            # @DO 26 0#
            # @DO 27 0#
            # @DO 28 0#
            # @DO 29 1#
            # @DO 30 1#
            # @DO 31 1#
            # @DO 32 1#
            # @DO 33 0#
            #
            # 03,08,2020
            # 19:51
            Insert Into Array(inArray=w138, new=w139) -> w140
            call "VISA Multiple Write.gvi"(VISA_IN=w134, ARRAY_IN=w140, ERROR_IN=w135) -> (ERROR_OUT=w136)
            w137 = w132
          }
          frame "Parallel 2" {
            # @DO 17 1#
            # @DO 18 0#
            # @DO 23 1#
            # @DO 24 0#
            # @DO 25 1#
            # @DO 26 1#
            # @DO 27 1#
            # @DO 28 1#
            # @DO 29 1#
            # @DO 30 1#
            # @DO 31 1#
            # @DO 32 1#
            # @DO 33 1#
            #
            # 03.08.2020
            # 19.53
            w141 = ["@DO 17 1#", "@DO 18 0#", "@DO 23 1#", "@DO 24 0#", "@DO 25 1#", "@DO 26 1#", "@DO 27 1#", "@DO 28 1#", "@DO 29 1#", "@DO 30 1#", "@DO 31 1#", "@DO 32 1#", "@DO 33 1#"]
            # Disconnect all Diodes
            w142 = ["@DO 54 1#", "@DO 55 1#", "@DO 56 1#", "@DO 57 1#", "@DO 58 1#", "@DO 59 1#", "@DO 60 1#", "@DO 61 1#"]
            Insert Into Array(inArray=w141, new=w142) -> w143
            call "VISA Multiple Write.gvi"(VISA_IN=w134, ARRAY_IN=w143, ERROR_IN=w135) -> (ERROR_OUT=w136)
            w137 = w132
          }
          frame "Parallel 2 Diode" {
            # @DO 17 1#
            # @DO 18 0#
            # @DO 23 1#
            # @DO 24 0#
            # @DO 25 1#
            # @DO 26 1#
            # @DO 27 1#
            # @DO 28 1#
            # @DO 29 1#
            # @DO 30 1#
            # @DO 31 1#
            # @DO 32 1#
            # @DO 33 1#
            #
            # 03.08.2020
            # 19.54
            w144 = ["@DO 17 1#", "@DO 18 0#", "@DO 23 1#", "@DO 24 0#", "@DO 25 1#", "@DO 26 1#", "@DO 27 1#", "@DO 28 1#", "@DO 29 1#", "@DO 30 1#", "@DO 31 1#", "@DO 32 1#", "@DO 33 1#"]
            # @DO 56 0#
            # @DO 57 0#
            #
            # 19.54
            w145 = ["@DO 54 1#", "@DO 55 1#", "@DO 56 0#", "@DO 57 0#", "@DO 58 1#", "@DO 59 1#", "@DO 60 1#", "@DO 61 1#"]
            Insert Into Array(inArray=w144, new=w145) -> w146
            call "VISA Multiple Write.gvi"(VISA_IN=w134, ARRAY_IN=w146, ERROR_IN=w135) -> (ERROR_OUT=w136)
            w137 = w132
          }
          frame "Series 2" {
            # @DO 17 0#
            # @DO 18 1#
            # @DO 23 1#
            # @DO 24 0#
            # @DO 25 1#
            # @DO 26 1#
            # @DO 27 1#
            # @DO 28 1#
            # @DO 29 0#
            # @DO 30 1#
            # @DO 31 1#
            # @DO 32 0#
            # @DO 33 0#
            #
            # 03.08.2020
            # 19.55
            w147 = ["@DO 17 0#", "@DO 18 1#", "@DO 23 1#", "@DO 24 0#", "@DO 25 1#", "@DO 26 1#", "@DO 27 1#", "@DO 28 1#", "@DO 29 0#", "@DO 30 1#", "@DO 31 1#", "@DO 32 0#", "@DO 33 0#"]
            w148 = ["@DO 54 1#", "@DO 55 1#", "@DO 56 1#", "@DO 57 1#", "@DO 58 1#", "@DO 59 1#", "@DO 60 1#", "@DO 61 1#"]
            Insert Into Array(inArray=w147, new=w148) -> w149
            call "VISA Multiple Write.gvi"(VISA_IN=w134, ARRAY_IN=w149, ERROR_IN=w135) -> (ERROR_OUT=w136)
            w137 = w132
          }
          frame "Series 2 Diode" {
            # @DO 17 0#
            # @DO 18 1#
            # @DO 23 1#
            # @DO 24 0#
            # @DO 25 1#
            # @DO 26 1#
            # @DO 27 1#
            # @DO 28 1#
            # @DO 29 0#
            # @DO 30 1#
            # @DO 31 1#
            # @DO 32 0#
            # @DO 33 0#
            #
            # 03.08.2020
            # 19.57
            w150 = ["@DO 17 0#", "@DO 18 1#", "@DO 23 1#", "@DO 24 0#", "@DO 25 1#", "@DO 26 1#", "@DO 27 1#", "@DO 28 1#", "@DO 29 0#", "@DO 30 1#", "@DO 31 1#", "@DO 32 0#", "@DO 33 0#"]
            # @DO 60 0#
            # @DO 61 0#
            #
            # 03.08.2020
            w151 = ["@DO 54 1#", "@DO 55 1#", "@DO 56 1#", "@DO 57 1#", "@DO 58 1#", "@DO 59 1#", "@DO 60 0#", "@DO 61 0#"]
            Insert Into Array(inArray=w150, new=w151) -> w152
            call "VISA Multiple Write.gvi"(VISA_IN=w134, ARRAY_IN=w152, ERROR_IN=w135) -> (ERROR_OUT=w136)
            w137 = w132
          }
          frame "Parallel 4", Default {
            # @DO 17 1#
            # @DO 18 1#
            # @DO 23 1#
            # @DO 24 1#
            # @DO 25 1#
            # @DO 26 1#
            # @DO 27 1#
            # @DO 28 1#
            # @DO 29 1#
            # @DO 30 1#
            # @DO 31 1#
            # @DO 32 1#
            # @DO 33 1#
            #
            # 03.08.2020
            # 19.59
            w153 = ["@DO 17 1#", "@DO 18 1#", "@DO 23 1#", "@DO 24 1#", "@DO 25 1#", "@DO 26 1#", "@DO 27 1#", "@DO 28 1#", "@DO 29 1#", "@DO 30 1#", "@DO 31 1#", "@DO 32 1#", "@DO 33 1#"]
            w154 = ["@DO 54 1#", "@DO 55 1#", "@DO 56 1#", "@DO 57 1#", "@DO 58 1#", "@DO 59 1#", "@DO 60 1#", "@DO 61 1#"]
            Insert Into Array(inArray=w153, new=w154) -> w155
            call "VISA Multiple Write.gvi"(VISA_IN=w134, ARRAY_IN=w155, ERROR_IN=w135) -> (ERROR_OUT=w136)
            w137 = "Parallel 4"
          }
          frame "Parallel 4 Diode" {
            # @DO 17 1#
            # @DO 18 1#
            # @DO 23 1#
            # @DO 24 1#
            # @DO 25 1#
            # @DO 26 1#
            # @DO 27 1#
            # @DO 28 1#
            # @DO 29 1#
            # @DO 30 1#
            # @DO 31 1#
            # @DO 32 1#
            # @DO 33 1#
            # 03.08.2020
            # 20.00
            w156 = ["@DO 17 1#", "@DO 18 1#", "@DO 23 1#", "@DO 24 1#", "@DO 25 1#", "@DO 26 1#", "@DO 27 1#", "@DO 28 1#", "@DO 29 1#", "@DO 30 1#", "@DO 31 1#", "@DO 32 1#", "@DO 33 1#"]
            # @DO 54 0#
            # @DO 55 0#
            # @DO 56 0#
            # @DO 57 0#
            #
            # 03.08.2020
            # 20.00
            w157 = ["@DO 54 0#", "@DO 55 0#", "@DO 56 0#", "@DO 57 0#", "@DO 58 1#", "@DO 59 1#", "@DO 60 1#", "@DO 61 1#"]
            Insert Into Array(inArray=w156, new=w157) -> w158
            call "VISA Multiple Write.gvi"(VISA_IN=w134, ARRAY_IN=w158, ERROR_IN=w135) -> (ERROR_OUT=w136)
            w137 = w132
          }
          frame "Series 4" {
            # @DO 17 0#
            # @DO 18 1#
            # @DO 23 0#
            # @DO 24 1#
            # @DO 25 1#
            # @DO 26 0#
            # @DO 27 0#
            # @DO 28 0#
            # @DO 29 0#
            # @DO 30 0#
            # @DO 31 0#
            # @DO 32 0#
            # @DO 33 0#
            #
            # 03.08.2020
            # 20.02
            w159 = ["@DO 17 0#", "@DO 18 1#", "@DO 23 0#", "@DO 24 1#", "@DO 25 1#", "@DO 26 0#", "@DO 27 0#", "@DO 28 0#", "@DO 29 0#", "@DO 30 0#", "@DO 31 0#", "@DO 32 0#", "@DO 33 0#"]
            w160 = ["@DO 54 1#", "@DO 55 1#", "@DO 56 1#", "@DO 57 1#", "@DO 58 1#", "@DO 59 1#", "@DO 60 1#", "@DO 61 1#"]
            Insert Into Array(inArray=w159, new=w160) -> w161
            call "VISA Multiple Write.gvi"(VISA_IN=w134, ARRAY_IN=w161, ERROR_IN=w135) -> (ERROR_OUT=w136)
            w137 = w132
          }
          frame "Series 4 Diode" {
            # @DO 17 0#
            # @DO 18 1#
            # @DO 23 0#
            # @DO 24 1#
            # @DO 25 1#
            # @DO 26 0#
            # @DO 27 0#
            # @DO 28 0#
            # @DO 29 0#
            # @DO 30 0#
            # @DO 31 0#
            # @DO 32 0#
            # @DO 33 0#
            #
            # 03.08.2020
            # 20.03
            w162 = ["@DO 17 0#", "@DO 18 1#", "@DO 23 0#", "@DO 24 1#", "@DO 25 1#", "@DO 26 0#", "@DO 27 0#", "@DO 28 0#", "@DO 29 0#", "@DO 30 0#", "@DO 31 0#", "@DO 32 0#", "@DO 33 0#"]
            # @DO 58 0#
            # @DO 59 0#
            # @DO 60 0#
            # @DO 61 0#
            #
            # 03.08.2020
            # 20.04
            w163 = ["@DO 54 1#", "@DO 55 1#", "@DO 56 1#", "@DO 57 1#", "@DO 58 0#", "@DO 59 0#", "@DO 60 0#", "@DO 61 0#"]
            Insert Into Array(inArray=w162, new=w163) -> w164
            call "VISA Multiple Write.gvi"(VISA_IN=w134, ARRAY_IN=w164, ERROR_IN=w135) -> (ERROR_OUT=w136)
            w137 = w132
          }
          frame "Parallel Of Series" {
            # @DO 17 1#
            # @DO 18 1#
            # @DO 23 1#
            # @DO 24 1#
            # @DO 25 1#
            # @DO 26 1#
            # @DO 27 0#
            # @DO 28 1#
            # @DO 29 0#
            # @DO 30 0#
            # @DO 31 1#
            # @DO 32 0#
            # @DO 33 1#
            #
            # 03.08.2020
            # 20.05
            w165 = ["@DO 17 1#", "@DO 18 1#", "@DO 23 1#", "@DO 24 1#", "@DO 25 1#", "@DO 26 1#", "@DO 27 0#", "@DO 28 1#", "@DO 29 0#", "@DO 30 0#", "@DO 31 1#", "@DO 32 0#", "@DO 33 1#"]
            w166 = ["@DO 54 1#", "@DO 55 1#", "@DO 56 1#", "@DO 57 1#", "@DO 58 1#", "@DO 59 1#", "@DO 60 1#", "@DO 61 1#"]
            Insert Into Array(inArray=w165, new=w166) -> w167
            call "VISA Multiple Write.gvi"(VISA_IN=w134, ARRAY_IN=w167, ERROR_IN=w135) -> (ERROR_OUT=w136)
            w137 = w132
          }
          frame "Parallel Of Series Diode" {
            # @DO 17 1#
            # @DO 18 1#
            # @DO 23 1#
            # @DO 24 1#
            # @DO 25 1#
            # @DO 26 1#
            # @DO 27 0#
            # @DO 28 1#
            # @DO 29 0#
            # @DO 30 0#
            # @DO 31 1#
            # @DO 32 0#
            # @DO 33 1#
            #
            # 03.08.2020
            # 20.06
            # @DO 58 0#
            # @DO 59 0#
            # @DO 60 0#
            # @DO 61 0#
            #
            # 03.08.2020
            # 20.097
            w168 = ["@DO 17 1#", "@DO 18 1#", "@DO 23 1#", "@DO 24 1#", "@DO 25 1#", "@DO 26 1#", "@DO 27 0#", "@DO 28 1#", "@DO 29 0#", "@DO 30 0#", "@DO 31 1#", "@DO 32 0#", "@DO 33 1#"]
            w169 = ["@DO 54 1#", "@DO 55 1#", "@DO 56 1#", "@DO 57 1#", "@DO 58 0#", "@DO 59 0#", "@DO 60 0#", "@DO 61 0#"]
            Insert Into Array(inArray=w168, new=w169) -> w170
            call "VISA Multiple Write.gvi"(VISA_IN=w134, ARRAY_IN=w170, ERROR_IN=w135) -> (ERROR_OUT=w136)
            w137 = w132
          }
          frame "Series Of Parallel" {
            w171 = ["@DO 54 1#", "@DO 55 1#", "@DO 56 1#", "@DO 57 1#", "@DO 58 1#", "@DO 59 1#", "@DO 60 1#", "@DO 61 1#"]
            # @DO 17 1#
            # @DO 18 0#
            # @DO 23 0#
            # @DO 24 0#
            # @DO 25 0#
            # @DO 26 1#
            # @DO 27 1#
            # @DO 28 1#
            # @DO 29 1#
            # @DO 30 1#
            # @DO 31 1#
            # @DO 32 1#
            # @DO 33 1#
            #
            # 03.08.2020
            # 20.07
            w172 = ["@DO 17 1#", "@DO 18 0#", "@DO 23 0#", "@DO 24 0#", "@DO 25 0#", "@DO 26 1#", "@DO 27 1#", "@DO 28 1#", "@DO 29 1#", "@DO 30 1#", "@DO 31 1#", "@DO 32 1#", "@DO 33 1#"]
            Insert Into Array(inArray=w172, new=w171) -> w173
            call "VISA Multiple Write.gvi"(VISA_IN=w134, ARRAY_IN=w173, ERROR_IN=w135) -> (ERROR_OUT=w136)
            w137 = w132
          }
          frame "Series Of Parallel Diode" {
            # @DO 17 1#
            # @DO 18 0#
            # @DO 23 0#
            # @DO 24 0#
            # @DO 25 0#
            # @DO 26 1#
            # @DO 27 1#
            # @DO 28 1#
            # @DO 29 1#
            # @DO 30 1#
            # @DO 31 1#
            # @DO 32 1#
            # @DO 33 1#
            #
            # 03.08.2020
            # 20.08
            w174 = ["@DO 17 1#", "@DO 18 0#", "@DO 23 0#", "@DO 24 0#", "@DO 25 0#", "@DO 26 1#", "@DO 27 1#", "@DO 28 1#", "@DO 29 1#", "@DO 30 1#", "@DO 31 1#", "@DO 32 1#", "@DO 33 1#"]
            # @DO 54 0#
            # @DO 55 0#
            # @DO 56 0#
            # @DO 57 0#
            #
            # 20.09
            # 03.08.2020
            w175 = ["@DO 54 0#", "@DO 55 0#", "@DO 56 0#", "@DO 57 0#", "@DO 58 1#", "@DO 59 1#", "@DO 60 1#", "@DO 61 1#"]
            Insert Into Array(inArray=w174, new=w175) -> w176
            call "VISA Multiple Write.gvi"(VISA_IN=w134, ARRAY_IN=w176, ERROR_IN=w135) -> (ERROR_OUT=w136)
            w137 = w132
          }
        }
        call "Panel Switch.gvi"(VISA_IN=w131, CTRL="Connect", ERROR_IN=w136) -> (ERROR_OUT=w51)
        Property Node(instance in=reference to "PV-Panel Cofiguration", "ValueSignaling"=w137)
        w52 = s3
        w53 = default
      }
      frame "Prepare CVM" {
        Property Node(instance in=s4) -> ("VISA Resource"=w177, "Physical Channel"=w178, instance out=w54)
        call "DAQmx Read (Analog 2D DBL NChan NSamp).gvi"(task in=w178, error in=w50, number of samples per channel=1) -> (error out=w179, data=w180)
        Array Index(array=w180) -> (out0[2, 0]=w181)
        Multiply(w181, 4) -> w182
        C Code Node("x"=w182, Error In=w179) -> ("y"=w183, Error Out=w184)
        ~~~
        if(x>-1 && x<=1)
          y = 0;
        if(x>1 && x<=10)
          y = 1;
        if(x>10 && x<=20)
          y = 2;
        if(x>20 && x<=30)
          y = 3;
        ~~~
        Array Index(array=w180) -> (out0[3, 0]=w185)
        # Tip For Local Wiring Solution
        # Relay 1(50) 	DO 1- REP A x1
        # 		DO 0- AMP A x10
        #
        # Relay 2(51) 	DO 1-REP V x1
        # 		DO 0-DIV V x0.25
        # Relay 3(52) 	DO 1-REP V x1
        # 		DO 0-DIV V x0.5
        # Relay 4(53) 	DO 1-REP V x1
        # 		DO 0-AMP V x10
        C Code Node("x"=w185, Error In=w184) -> ("y"=w186, Error Out=w187)
        ~~~
        if(x>-1 && x<=0.6)
          y = 0;
        if(x>0.6 && x<=6)
          y = 1;
        ~~~
        # Voltage Range
        case (w183) {
          frame 0, Default {
            call "VISA Multiple Write.gvi"(VISA_IN=w177, ARRAY_IN=["@DO 51 1#", "@DO 52 1#", "@DO 53 0#"], ERROR_IN=w187) -> (VISA Answer=w190, ERROR_OUT=w188)
            w189 = 0.1
          }
          frame 1 {
            call "VISA Multiple Write.gvi"(VISA_IN=w177, ARRAY_IN=["@DO 51 1#", "@DO 52 1#", "@DO 53 1#"], ERROR_IN=w187) -> (VISA Answer=w190, ERROR_OUT=w188)
            w189 = 1
          }
          frame 2 {
            call "VISA Multiple Write.gvi"(VISA_IN=w177, ARRAY_IN=["@DO 51 1#", "@DO 52 0#", "@DO 53 1#"], ERROR_IN=w187) -> (VISA Answer=w190, ERROR_OUT=w188)
            w189 = 0.5
          }
          frame 3 {
            # Div x0.25 works with 2 relay
            call "VISA Multiple Write.gvi"(VISA_IN=w177, ARRAY_IN=["@DO 51 0#\n"], ERROR_IN=w187) -> (VISA Answer=w190, ERROR_OUT=w188)
            w189 = 0.25
          }
        }
        $"V Coeff" <- w189
        $"VISA Answer_2" <- w190
        # Current Range
        case (w186) {
          frame 0, Default {
            call "VISA Multiple Write.gvi"(VISA_IN=w177, ARRAY_IN=["@DO 50 0#"], ERROR_IN=w188) -> (ERROR_OUT=w51)
            w191 = 0.1
          }
          frame 1 {
            call "VISA Multiple Write.gvi"(VISA_IN=w177, ARRAY_IN=["@DO 50 1#"], ERROR_IN=w188) -> (ERROR_OUT=w51)
            w191 = 1
          }
        }
        $"C Coeff" <- w191
        w52 = s3
        w53 = default
      }
      frame "Reset CVM" {
        $"V Coeff" <- 1
        $"C Coeff" <- 1
        Property Node(instance in=s4) -> ("VISA Resource"=w192, instance out=w54)
        # VOLTAGE RANGE
        # @DO 51 0#
        # @DO 52 0#
        # @DO 53 0#
        call "VISA Multiple Write.gvi"(VISA_IN=w192, ARRAY_IN=["@DO 51 1#", "@DO 52 1#", "@DO 53 1#"], ERROR_IN=w50) -> (VISA_OUT=w193, ERROR_OUT=w194)
        # CURRENT RANGE
        # @DO 50 1#
        call "VISA Multiple Write.gvi"(VISA_IN=w193, ARRAY_IN=["@DO 50 1#"], ERROR_IN=w194) -> (ERROR_OUT=w51)
        w52 = s3
        w53 = default
      }
      frame "VAC" {
        w195 = ["0", "1,", "10,", "20,10,", "50,", "50,20,", "100,", "100,40,10,", "200,100,", "500,100,", "1000,", "2000,", "2000,1000,", "4000,", "4000,1000,", "4000,2000,", "4000,2000,1000,", "4000,2000,1000,500,400,100,"]
        Array Size(array=w195) -> (size(s)=w196)
        Is Less Or Equal(x=$"VAC Load Counter", y=w196) -> w197
        Property Node(instance in=s4) -> ("VISA Resource"=w198, "Physical Channel"=w199, instance out=w54)
        Variant To Data(type=timestamp 1904-01-01T00:00:00Z, variant=w49) -> (data=w200)
        Get Current Time() -> (current time=w201)
        Timestamp Subtract(x=w201, y=w200) -> w202
        Is Greater Or Equal(x=w202, y=5) -> w203
        Logical And(w203, w197) -> w204
        case (w204) {
          frame False, Default {
            w205 = w50
            w206 = w200
            w207 = $"VAC Load Counter"
          }
          frame True {
            Get Current Time() -> (current time=w206)
            # Disconnect ALL load
            Array Index(array=w195) -> (out0[$"VAC Load Counter"]=w208)
            w209 = ["@DO 42 1#", "@DO 34 0#", "@DO 35 0#", "@DO 36 0#", "@DO 37 0#", "@DO 38 0#", "@DO 39 0#", "@DO 40 0#", "@DO 41 0#", "@DO 43 0#", "@DO 44 0#", "@DO 45 0#", "@DO 46 0#", "@DO 47 0#", "@DO 48 0#", "@DO 49 0#"]
            call "VISA Multiple Write.gvi"(VISA_IN=w198, ARRAY_IN=w209, ERROR_IN=w50) -> (ERROR_OUT=w210)
            s5 = w208  # shift register
            while {
              Match Pattern(regular expression=",", string=s5) -> (after substring=w211, before substring=w212)
              case (w212) {
                frame "1" {
                  call "VISA ReadWrite.gvi"(VISA_IN=w198, CMD="@DO 43 1#", ERROR_IN=w210) -> (ERROR_OUT=w213)
                }
                frame "2" {
                  call "VISA ReadWrite.gvi"(VISA_IN=w198, CMD="@DO 44 1#", ERROR_IN=w210) -> (ERROR_OUT=w213)
                }
                frame "3" {
                  call "VISA ReadWrite.gvi"(VISA_IN=w198, CMD="@DO 45 1#", ERROR_IN=w210) -> (ERROR_OUT=w213)
                }
                frame "5" {
                  call "VISA ReadWrite.gvi"(VISA_IN=w198, CMD="@DO 46 1#", ERROR_IN=w210) -> (ERROR_OUT=w213)
                }
                frame "10" {
                  call "VISA ReadWrite.gvi"(VISA_IN=w198, CMD="@DO 47 1#", ERROR_IN=w210) -> (ERROR_OUT=w213)
                }
                frame "20" {
                  call "VISA ReadWrite.gvi"(VISA_IN=w198, CMD="@DO 48 1#", ERROR_IN=w210) -> (ERROR_OUT=w213)
                }
                frame "40" {
                  call "VISA ReadWrite.gvi"(VISA_IN=w198, CMD="@DO 49 1#", ERROR_IN=w210) -> (ERROR_OUT=w213)
                }
                frame "50" {
                  call "VISA ReadWrite.gvi"(VISA_IN=w198, CMD="@DO 34 1#", ERROR_IN=w210) -> (ERROR_OUT=w213)
                }
                frame "100" {
                  call "VISA ReadWrite.gvi"(VISA_IN=w198, CMD="@DO 35 1#", ERROR_IN=w210) -> (ERROR_OUT=w213)
                }
                frame "200" {
                  call "VISA ReadWrite.gvi"(VISA_IN=w198, CMD="@DO 36 1#", ERROR_IN=w210) -> (ERROR_OUT=w213)
                }
                frame "400" {
                  call "VISA ReadWrite.gvi"(VISA_IN=w198, CMD="@DO 37 1#", ERROR_IN=w210) -> (ERROR_OUT=w213)
                }
                frame "500" {
                  call "VISA ReadWrite.gvi"(VISA_IN=w198, CMD="@DO 38 1#", ERROR_IN=w210) -> (ERROR_OUT=w213)
                }
                frame "1000" {
                  call "VISA ReadWrite.gvi"(VISA_IN=w198, CMD="@DO 39 1#", ERROR_IN=w210) -> (ERROR_OUT=w213)
                }
                frame "2000" {
                  call "VISA ReadWrite.gvi"(VISA_IN=w198, CMD="@DO 40 1#", ERROR_IN=w210) -> (ERROR_OUT=w213)
                }
                frame "4000" {
                  call "VISA ReadWrite.gvi"(VISA_IN=w198, CMD="@DO 41 1#", ERROR_IN=w210) -> (ERROR_OUT=w213)
                }
                frame "0", Default {
                  # Для измерения тока К.З.
                  # Схема сопротивления
                  # 1 Ом + 1 Ом токовый резистор
                  w213 = w210
                }
              }
              Is Empty String Or Path(string/path=w211) -> w214
              next s5 = w211
              stop if w214
            }
            call "VISA ReadWrite.gvi"(VISA_IN=w198, CMD="@DO 42 0#", ERROR_IN=w213) -> (ERROR_OUT=w205)
            Increment(x=$"VAC Load Counter") -> w207
          }
        }
        call "Enqueue Message (Single).gvi"(message queue in=w47, message="Watchdog", error in=w205) -> (message queue out=w215, error out=w216)
        case (w197) {
          frame False, Default {
            call "Enqueue Message (Single).gvi"(message queue in=w215, message="NoLoad", error in=w216) -> (error out=w51)
          }
          frame True {
            call "Enqueue Message (Single).gvi"(message queue in=w215, message="VAC", message data=w206, error in=w216) -> (error out=w51)
          }
        }
        $"VAC Load Counter" <- w207
        call "DAQmx Read (Analog 2D DBL NChan NSamp).gvi"(task in=w199, number of samples per channel=1) -> (data=w217)
        Array Index(array=w217) -> (out0[1, 0]=w218)
        Multiply(w218, 4) -> w219
        Feedback Node(input=w220) -> w221
        Build Array(w221, w219) -> w220
        Array Index(array=w217) -> (out0[0, 0]=w222)
        Divide(x=w222, y=70) -> w223
        Multiply(w223, 1000) -> w224
        Feedback Node(input=w225) -> w226
        Build Array(w226, w224) -> w225
        Build Cluster(w220, w225) -> w227
        $VAC <- w227
        w52 = s3
        w53 = default
      }
      frame "Optic Filter Config" {
        Variant To Data(error in (no error)=w50, type=string "", variant=w49) -> (data=w228, error out=w229)
        case (w228) {
          frame "No Filter", Default {
            w230 = ["@SERV 3 90#", "@SERV 4 0#"]
            w231 = "No Filter"
          }
          frame "Filter 1" {
            w230 = ["@SERV 3 90#", "@SERV 4 0#", "@SERV 3 0#"]
            w231 = w228
          }
          frame "Filter 2" {
            w230 = ["@SERV 3 90#", "@SERV 4 0#", "@SERV 4 90#"]
            w231 = w228
          }
        }
        Property Node(instance in=reference to "PV-Optical Filter", "ValueSignaling"=w231)
        Property Node(instance in=s4) -> ("VISA Resource"=w232, instance out=w54)
        call "VISA Multiple Write.gvi"(VISA_IN=w232, ARRAY_IN=w230, ERROR_IN=w229) -> (ERROR_OUT=w51)
        w52 = s3
        w53 = default
      }
      frame "Fans Control" {
        Variant To Data(error in (no error)=w50, type=string "", variant=w49) -> (data=w233, error out=w234)
        case (w233) {
          frame "0", Default {
            w235 = ["@DO 11 0#", "@DO 12 0#"]
            w236 = "0"
          }
          frame "100" {
            w235 = ["@PWM 11 255#", "@PWM 12 255#"]
            w236 = "100"
          }
          frame "50" {
            w235 = ["@PWM 11 127#", "@PWM 12 127#"]
            w236 = "50"
          }
        }
        Property Node(instance in=reference to "PV-Cooling", "ValueSignaling"=w236)
        Property Node(instance in=s4) -> ("VISA Resource"=w237, instance out=w54)
        call "VISA Multiple Write.gvi"(VISA_IN=w237, ARRAY_IN=w235, ERROR_IN=w234) -> (ERROR_OUT=w51)
        w52 = s3
        w53 = default
      }
      frame "Heat Config" {
        Variant To Data(error in (no error)=w50, type=string "", variant=w49) -> (data=w238, error out=w239)
        case (w238) {
          frame "0", Default {
            w240 = ["@DO 9 0#"]
            w241 = "0"
          }
          frame "50" {
            w240 = ["@PWM 9 125#"]
            w241 = "50"
          }
          frame "100" {
            w240 = ["@PWM 9 255#"]
            w241 = "100"
          }
        }
        Property Node(instance in=reference to "PV-Heating", "ValueSignaling"=w241)
        Property Node(instance in=s4) -> ("VISA Resource"=w242, instance out=w54)
        call "VISA Multiple Write.gvi"(VISA_IN=w242, ARRAY_IN=w240, ERROR_IN=w239) -> (ERROR_OUT=w51)
        w52 = s3
        w53 = default
      }
      frame "Set PV Angle" {
        Variant To Data(error in (no error)=w50, type=u32 0, variant=w49) -> (data=w243, error out=w244)
        # Set angle limits for PV panels
        In Range And Coerce(lower limit=0, upper limit=180, x=w243) -> (coerced(x)=w245)
        Property Node(instance in=reference to "PV-Panel Tilt Angle, º", "ValueSignaling"=w245)
        Property Node(instance in=s4) -> ("VISA Resource"=w246, instance out=w54)
        Number To Decimal String(number=w245) -> (decimal integer string=w247)
        Concatenate Strings("@SERV 13 ", w247, "#") -> w248
        call "VISA ReadWrite.gvi"(VISA_IN=w246, CMD=w248, ERROR_IN=w244) -> (ERROR_OUT=w51)
        w52 = s3
        w53 = default
      }
      frame "Brightness Config" {
        Property Node(instance in=s4) -> ("VISA Resource"=w249, instance out=w54)
        Variant To Data(error in (no error)=w50, type=u32 0, variant=w49) -> (data=w250, error out=w251)
        # Set brightness limits
        In Range And Coerce(lower limit=0, upper limit=100, x=w250) -> (coerced(x)=w252)
        Number To Decimal String(number=w252) -> (decimal integer string=w253)
        Concatenate Strings("@DIM 6 ", w253, "#") -> w254
        call "VISA ReadWrite.gvi"(VISA_IN=w249, CMD=w254, ERROR_IN=w251) -> (ERROR_OUT=w51)
        w52 = s3
        w53 = default
      }
      frame "IR Thermometer Position" {
        Variant To Data(error in (no error)=w50, type=string "", variant=w49) -> (data=w255, error out=w256)
        case (w255) {
          frame "None", Default {
            w257 = "@SERV 5 0#"
            w258 = w255
          }
          frame "Panel 1" {
            w257 = "@SERV 5 50#"
            w258 = w255
          }
          frame "Panel 2" {
            w257 = "@SERV 5 75#"
            w258 = w255
          }
          frame "Panel 3" {
            w257 = "@SERV 5 110#"
            w258 = w255
          }
          frame "Panel 4" {
            w257 = "@SERV 5 130#"
            w258 = w255
          }
        }
        Property Node(instance in=reference to "PV-Temperature IR Position", "ValueSignaling"=w258)
        Property Node(instance in=s4) -> ("VISA Resource"=w259, instance out=w54)
        call "VISA ReadWrite.gvi"(VISA_IN=w259, CMD=w257, ERROR_IN=w256) -> (ERROR_OUT=w51)
        w52 = s3
        w53 = default
      }
      frame "Set LoadR" {
        Property Node(instance in=s4) -> ("VISA Resource"=w260, instance out=w54)
        Variant To Data(error in (no error)=w50, type=string "", variant=w49) -> (data=w261, error out=w262)
        # Disconnect ALL load
        w263 = ["@DO 42 1#", "@DO 34 0#", "@DO 35 0#", "@DO 36 0#", "@DO 37 0#", "@DO 38 0#", "@DO 39 0#", "@DO 40 0#", "@DO 41 0#", "@DO 43 0#", "@DO 44 0#", "@DO 45 0#", "@DO 46 0#", "@DO 47 0#", "@DO 48 0#", "@DO 49 0#"]
        sequence {
          frame 0 {
            call "VISA Multiple Write.gvi"(VISA_IN=w260, ARRAY_IN=w263, ERROR_IN=w262) -> (VISA_OUT=w264, ERROR_OUT=w265)
            $"Total Set LoadR" <- 1
          }
        }
        s6 = w261  # shift register
        s7 = 0  # shift register
        s8 = ""  # shift register
        while {
          Match Pattern(regular expression=",", string=s6) -> (after substring=w266, before substring=w267)
          s9 = w267  # shift register
          s10 = s7  # shift register
          while {
            Match Pattern(regular expression=",", string=s9) -> (after substring=w268, before substring=w269)
            case (w269) {
              frame "1" {
                call "VISA ReadWrite.gvi"(VISA_IN=w264, CMD="@DO 43 1#", ERROR_IN=w265) -> (ERROR_OUT=w270)
                w271 = w269
              }
              frame "2" {
                call "VISA ReadWrite.gvi"(VISA_IN=w264, CMD="@DO 44 1#", ERROR_IN=w265) -> (ERROR_OUT=w270)
                w271 = w269
              }
              frame "3" {
                call "VISA ReadWrite.gvi"(VISA_IN=w264, CMD="@DO 45 1#", ERROR_IN=w265) -> (ERROR_OUT=w270)
                w271 = w269
              }
              frame "5" {
                call "VISA ReadWrite.gvi"(VISA_IN=w264, CMD="@DO 46 1#", ERROR_IN=w265) -> (ERROR_OUT=w270)
                w271 = w269
              }
              frame "10" {
                call "VISA ReadWrite.gvi"(VISA_IN=w264, CMD="@DO 47 1#", ERROR_IN=w265) -> (ERROR_OUT=w270)
                w271 = w269
              }
              frame "20" {
                call "VISA ReadWrite.gvi"(VISA_IN=w264, CMD="@DO 48 1#", ERROR_IN=w265) -> (ERROR_OUT=w270)
                w271 = w269
              }
              frame "40" {
                call "VISA ReadWrite.gvi"(VISA_IN=w264, CMD="@DO 49 1#", ERROR_IN=w265) -> (ERROR_OUT=w270)
                w271 = w269
              }
              frame "50" {
                call "VISA ReadWrite.gvi"(VISA_IN=w264, CMD="@DO 34 1#", ERROR_IN=w265) -> (ERROR_OUT=w270)
                w271 = w269
              }
              frame "100" {
                call "VISA ReadWrite.gvi"(VISA_IN=w264, CMD="@DO 35 1#", ERROR_IN=w265) -> (ERROR_OUT=w270)
                w271 = w269
              }
              frame "200" {
                call "VISA ReadWrite.gvi"(VISA_IN=w264, CMD="@DO 36 1#", ERROR_IN=w265) -> (ERROR_OUT=w270)
                w271 = w269
              }
              frame "400" {
                call "VISA ReadWrite.gvi"(VISA_IN=w264, CMD="@DO 37 1#", ERROR_IN=w265) -> (ERROR_OUT=w270)
                w271 = w269
              }
              frame "500" {
                call "VISA ReadWrite.gvi"(VISA_IN=w264, CMD="@DO 38 1#", ERROR_IN=w265) -> (ERROR_OUT=w270)
                w271 = w269
              }
              frame "1000" {
                call "VISA ReadWrite.gvi"(VISA_IN=w264, CMD="@DO 39 1#", ERROR_IN=w265) -> (ERROR_OUT=w270)
                w271 = w269
              }
              frame "2000" {
                call "VISA ReadWrite.gvi"(VISA_IN=w264, CMD="@DO 40 1#", ERROR_IN=w265) -> (ERROR_OUT=w270)
                w271 = w269
              }
              frame "4000" {
                call "VISA ReadWrite.gvi"(VISA_IN=w264, CMD="@DO 41 1#", ERROR_IN=w265) -> (ERROR_OUT=w270)
                w271 = w269
              }
              frame "0", Default {
                # Short Circut
                # Схема сопротивления
                # 1 Ом + 1 Ом токовый резистор
                w270 = w265
                w271 = "Short Circuit (<1 Ohm)"
              }
            }
            Decimal String To Number(string=w271) -> (number=w272)
            Add(w272, s10) -> w273
            $"Total Set LoadR" <- w273
            Concatenate Strings(s8, ",", w271) -> w274
            $"Total LoadR_SET" <- w274
            Is Empty String Or Path(string/path=w268) -> w275
            next s9 = w268
            next s10 = w273
            stop if w275
          }
          Is Empty String Or Path(string/path=w266) -> w276
          next s6 = w266
          next s7 = s10
          next s8 = w274
          stop if w276
        }
        # Connect Load
        call "VISA ReadWrite.gvi"(VISA_IN=w260, CMD="@DO 42 0#", ERROR_IN=w270) -> (ERROR_OUT=w51)
        $"Total Set LoadR" <- s7
        Property Node(instance in=reference to "PV-LoadR,Ohm", "ValueSignaling"=s7)
        $"Total LoadR_SET" <- s8
        Property Node(instance in=reference to "PV-LoadRTotal", "ValueSignaling"=s8)
        w52 = s3
        w53 = default
      }
      frame "NoLoad" {
        # Сопротивление в начальное положение
        Property Node(instance in=reference to "PV-LoadRTotal", "ValueSignaling"="Disconnected (NO LOAD)")
        $"Total LoadR_SET" <- "Disconnected (NO LOAD)"
        Property Node(instance in=reference to "PV-LoadR,Ohm", "ValueSignaling"=-1)
        $"Total Set LoadR" <- -1
        Property Node(instance in=s4) -> ("VISA Resource"=w277, instance out=w54)
        # Размыкаются всё реле, сопротивление- бесконечность
        w278 = ["@DO 42 1#", "@DO 34 1#", "@DO 35 1#", "@DO 36 1#", "@DO 37 1#", "@DO 38 1#", "@DO 39 1#", "@DO 40 1#", "@DO 41 1#", "@DO 43 1#", "@DO 44 1#", "@DO 45 1#", "@DO 46 1#", "@DO 47 1#", "@DO 48 1#", "@DO 49 1#"]
        # Disconnect all Load adn breake circuit
        # NO LOAD
        call "VISA Multiple Write.gvi"(VISA_IN=w277, ARRAY_IN=w278, ERROR_IN=w50) -> (ERROR_OUT=w51)
        w52 = s3
        w53 = default
      }
      frame "Error" {
        Variant To Data(error in (no error)=w50, type=no error, variant=w49) -> (data=w279, error out=w51)
        # #CodeRecommended - If you ever change the name of this "Error" message, you'll need to update the name in the Check Loop Error.vi as well.
        call "Display Error.gvi"(error in=w279)
        w52 = s3
        w53 = default
        w54 = s4
      }
      frame "Exit" {
        Generate User Event(event data=TRUE, user event=w26) -> (error out=w280)
        Release Queue(error in=w50, queue=w47) -> (error out=w281)
        Property Node(instance in=s4) -> ("VISA Resource"=w282, "Physical Channel"=w283)
        call "DAQmx Stop Task.gvi"(task in=w283) -> (error out=w284)
        call "Close (Instr).gvi"(session in=w282, error in=w284) -> (error out=w285)
        Merge Errors(w285, w280, w281) -> (error out=w51)
        w52 = s3
        w53 = TRUE
        w54 = default
      }
      frame Default {
        w286 = "The invalid message string \"%s\" was received in the Message Handling Loop."
        Format Into String(formatString=w286, w48) -> w287
        call "Build Error Cluster.gvi"(code=1, description=w287) -> (error out=w51)
        w52 = s3
        w53 = default
        w54 = s4
      }
    }
    call "Error Handler - Message Handling Loop.gvi"(message queue in=w47, error in=w51) -> (dup error in=w288)
    next s3 = w52
    next s4 = w54
    stop if w53
  }
  $"Server URL" <- "https://api.systemlinkcloud.com/"
  $"Exit 2" <- FALSE
  $SendArrayDoubleToCloud <- "Send Measured Data To Cloud"
  $SendStringToCloud <- "Send String To Cloud"
  $SendDoubleToCloud <- "Send Double To Cloud"
  w289 = bool FALSE  # Stop Event
  Create User Event[EventName="Stop Event"](user event data type=w289) -> (error out=w290, user event out=w291)
  call "Create All Message Queues.gvi"(error in=w290) -> (message queues=w292, error out=w293)
  Property Node(instance in=w292) -> ("UI"=w294)
  s11 = "UI Data.gtype" {all zero or empty}  # shift register
  while {
    call "Dequeue Message.gvi"(message queue in=w294, error in=w293) -> (message queue out=w295, message=w296, message data=w297, error out=w298)
    # s11: Data
    # w291: Stop Event
    case (w296) ignore case {  # Message Cases
      frame "Initialize" {
        Property Node(instance in=s11, "String"=w296) -> (instance out=w300)
        call "Enqueue Message (Single).gvi"(message queue in=w295, message="Update Display", message data=w296, error in=w298) -> (message queue out=w302, error out=w303)
        # Bundle a sample string value.
        call "Enqueue Message (Single).gvi"(message queue in=w302, message=$SendArrayDoubleToCloud, error in=w303) -> (error out=w299)
        Property Node(instance in=reference to "PV-Temperature, ºC", "ValueSignaling"=0)
        Property Node(instance in=reference to "MV-Panel Configuration", "Value"="none")
        Property Node(instance in=reference to "PV-Panel Cofiguration", "ValueSignaling"="none")
        Property Node(instance in=reference to "MV-Heating", "Value"="none")
        Property Node(instance in=reference to "PV-Temperature IR, ºC", "ValueSignaling"=0)
        Property Node(instance in=reference to "PV-Heating", "ValueSignaling"="none")
        Property Node(instance in=reference to "MV-Cooling", "Value"="none")
        Property Node(instance in=reference to "PV-LightIntensity, W/m2", "ValueSignaling"=0)
        Property Node(instance in=reference to "PV-Cooling", "ValueSignaling"="none")
        Property Node(instance in=reference to "MV-Light Power", "Value"="none")
        Property Node(instance in=reference to "PV-Panel Tilt Angle, º", "ValueSignaling"=0)
        Property Node(instance in=reference to "PV-Optical Filter", "ValueSignaling"="none")
        Property Node(instance in=reference to "MV-Optical Filter", "Value"="none")
        Property Node(instance in=reference to "PV-LigthPower, %", "ValueSignaling"=0)
        Property Node(instance in=reference to "PV-LoadR4", "ValueSignaling"="none")
        Property Node(instance in=reference to "MV-Panel Tilt Angle", "Value"="none")
        Property Node(instance in=reference to "PV-Voltage, V", "ValueSignaling"=0)
        Property Node(instance in=reference to "PV-LoadR3", "ValueSignaling"="none")
        Property Node(instance in=reference to "MV-LoadR1", "Value"="none")
        Property Node(instance in=reference to "PV-LoadR2", "ValueSignaling"="none")
        Property Node(instance in=reference to "PV-Current, mA", "ValueSignaling"=0)
        Property Node(instance in=reference to "MV-LoadR2", "Value"="none")
        Property Node(instance in=reference to "PV-LoadR1", "ValueSignaling"="none")
        Property Node(instance in=reference to "PV-LoadR,Ohm", "ValueSignaling"=0)
        Property Node(instance in=reference to "MV-LoadR3", "Value"="none")
        Property Node(instance in=reference to "PV-LoadRTotal", "ValueSignaling"="none")
        Property Node(instance in=reference to "MV-LoadR4", "Value"="none")
        Property Node(instance in=reference to "MV-LoadRTotal", "Value"="none")
        w301 = default
      }
      frame "Something" {
        # #CodeNeeded - Perform whatever actions correspond to the "Something" message.
        # Send string to "Update Display" message
        call "Enqueue Message (Single).gvi"(message queue in=w295, message="Update Display", message data="\"Do Something\" button pressed", error in=w298) -> (error out=w299)
        w300 = s11
        w301 = default
      }
      frame "Something Else" {
        # #CodeNeeded - Perform whatever actions correspond to the "Something Else" message.
        # Send string to "Update Display" message
        call "Enqueue Message (Single).gvi"(message queue in=w295, message="Update Display", message data="\"Do Something Else\" button pressed", error in=w298) -> (error out=w299)
        w300 = s11
        w301 = default
      }
      frame "Update Display" {
        # #CodeRecommended - If you wish to decouple the Message Handling Loop from your user interface, consider creating User Events (like the "Stop" event in this VI) to message the Event Handling Loop whenever the user interface needs updating.
        Variant To Data(error in (no error)=w298, type=string "", variant=w297) -> (data=w304, error out=w299)
        $"Status of Send to SystemLink Cycle" <- w304
        w300 = s11
        w301 = default
      }
      frame "Error" {
        Variant To Data(error in (no error)=w298, type=no error, variant=w297) -> (data=w305, error out=w299)
        # #CodeRecommended - Consider creating a system for logging errors in some way. These errors are for notification purposes only. Handling of specific errors should be performed in the message frames that generated the error.
        # #CodeRecommended - If you ever change the name of this "Error" message, you'll need to update the name in the Check Loop Error.vi as well.
        call "Display Error.gvi"(error in=w305)
        w300 = s11
        w301 = default
      }
      frame "---Copy This Frame---" {
        Merge Errors(w298) -> (error out=w299)
        w300 = s11
        w301 = default
      }
      frame "Exit" {
        # Release the message queue reference
        Release Queue(error in=w298, queue=w295) -> (error out=w306)
        # #CodeNeeded - Add any required cleanup code here. Note that if 'Exit' was called as a result of an error, an error dialog will be displayed. Add any custom error handling for an 'Exit' condition here as well.
        Generate User Event(event data=TRUE, user event=w291) -> (error out=w307)
        Merge Errors(w307, w306) -> (error out=w299)
        # Stop the VI
        $"Exit 2" <- TRUE
        w300 = s11
        w301 = TRUE
      }
      frame Default {
        w308 = "The invalid message string \"%s\" was received in the Message Handling Loop."
        Format Into String(formatString=w308, w296) -> w309
        call "Build Error Cluster.gvi"(code=1, description=w309) -> (error out=w299)
        w300 = s11
        w301 = default
      }
      frame "Send Double To Cloud" {
        Property Node(instance in=s11, "String"=w296) -> (instance out=w300)
        call "Open Configuration API Key.gvi"(server url=$"Server URL", api key=$"API Key", error in=w298) -> (configuration=w310)
        Variant To Data(type=string[] [], variant=w297) -> (data=w311)
        Array Index(array=w311) -> (out0[0]=w312, out1[1]=w313)
        Floating Point String To Number(string=w313) -> (number=w314)
        Build Array(w312) -> w315
        call "Query Tags.gvi"(paths=w315, configuration=w310) -> (tags=w316, error out=w317)
        Array Index(array=w316) -> (out0[_]=w318)
        Property Node(instance in=w318) -> ("Path"=w319, "Datatype"=w320)
        call "Open Tag.gvi"(path=w319, data type=w320, error in=w317, configuration=w310) -> (tag=w321, error out=w322)
        call "Write Tag (DBL).gvi"(tag in=w321, value=w314, error in=w322) -> (tag out=w323, error out=w324)
        call "Close Tag (Single).gvi"(tag=w323, error in=w324) -> (error out=w325)
        call "Close Configuration.gvi"(configuration=w310, error in=w325) -> (error out=w299)
        call "Enqueue Message (Single).gvi"(message queue in=w295, message="Update Display", message data=w296)
        w301 = default
      }
      frame "Send Measured Data To Cloud" {
        Property Node(instance in=s11, "String"=w296) -> (instance out=w300)
        call "Enqueue Message (Single).gvi"(message queue in=w295, message="Update Display", message data=w296, error in=w298) -> (message queue out=w326, error out=w327)
        call "Enqueue Message (Single).gvi"(message queue in=w326, message=$SendArrayDoubleToCloud, error in=w327) -> (error out=w328)
        call "Open Configuration API Key.gvi"(server url=$"Server URL", api key=$"API Key", error in=w328) -> (configuration=w329, error out=w330)
        w331 = ["PV-Current", "PV-Voltage", "PV-LigthtIntensity", "PV-Temperature"]
        call "Query Tags.gvi"(paths=w331, error in=w330, configuration=w329) -> (tags=w332, error out=w333)
        Property Node(instance in=$"Measured Data") -> ("Voltage, V"=w334, "Current, mA"=w335, "Luminous Flux, Lux"=w336, "Temperature, GradC"=w337)
        Build Array(w334, w335, w336, w337) -> w338
        for {
          w339 = each element of w332
          w340 = each element of w338
          Property Node(instance in=w339) -> ("Path"=w341, "Datatype"=w342)
          call "Open Tag.gvi"(path=w341, data type=w342, error in=w333, configuration=w329) -> (tag=w343, error out=w344)
          call "Write Tag (DBL).gvi"(tag in=w343, value=w340, error in=w344) -> (error out=w345)
        }
        for {
          w346 = each element of w332
          call "Close Tag (Single).gvi"(tag=w346, error in=w345) -> (error out=w347)
        }
        call "Close Configuration.gvi"(configuration=w329, error in=w347) -> (error out=w299)
        w301 = default
      }
      frame "Send String To Cloud" {
        Property Node(instance in=s11, "String"=w296) -> (instance out=w300)
        call "Open Configuration API Key.gvi"(server url=$"Server URL", api key=$"API Key", error in=w298) -> (configuration=w348, error out=w349)
        Variant To Data(type=string[] [], variant=w297) -> (data=w350)
        Array Index(array=w350) -> (out0[0]=w351, out1[1]=w352)
        Build Array(w351) -> w353
        call "Query Tags.gvi"(paths=w353, configuration=w348) -> (tags=w354)
        Array Index(array=w354) -> (out0[_]=w355)
        Property Node(instance in=w355) -> ("Path"=w356, "Datatype"=w357)
        call "Open Tag.gvi"(path=w356, data type=w357, error in=w349, configuration=w348) -> (tag=w358, error out=w359)
        call "Write Tag (String).gvi"(tag in=w358, value=w352, error in=w359) -> (tag out=w360, error out=w361)
        call "Close Tag (Single).gvi"(tag=w360, error in=w361) -> (error out=w362)
        call "Close Configuration.gvi"(configuration=w348, error in=w362) -> (error out=w299)
        call "Enqueue Message (Single).gvi"(message queue in=w295, message="Update Display", message data=w296)
        w301 = default
      }
    }
    call "Error Handler - Message Handling Loop.gvi"(message queue in=w295, error in=w299) -> (dup error in=w363)
    next s11 = w300
    stop if w301
  }
  Register For Events("Stop Event"=w291) -> (event registration refnum out=w364)
  s12 = w364  # shift register
  while {
    event (dynamic events = s12) {
      on "Do Something" Value changed {
        # #CodeNeeded - Send the appropriate message for this user interface event.
        call "Enqueue Message (Single).gvi"(message queue in=w294, message="Something") -> (message queue out=w367, error out=w366)
        w365 = default
      }
      on "Do Something Else" Value changed {
        # #CodeNeeded - Send the appropriate message for this user interface event.
        call "Enqueue Message (Single).gvi"(message queue in=w294, message="Something Else") -> (message queue out=w367, error out=w366)
        w365 = default
      }
      on "Exit" Value changed {
        call "Enqueue Message (Single).gvi"(priority message=TRUE, message queue in=w294, message="Exit") -> (message queue out=w367, error out=w366)
        w365 = default
      }
      on dynamic event 0 {
        # The Message Handling Loop processed an "Exit" message, which fired this event to stop the Event Handling Loop.
        $"Status of Send to SystemLink Cycle" <- "\"Exit\" button pressed"
        w365 = TRUE
        w366 = default
        w367 = w294
      }
      on "Window" Close? {
        call "Enqueue Message (Single).gvi"(priority message=TRUE, message queue in=w294, message="Exit") -> (message queue out=w367)
        Event Filter("Discard?"=TRUE)
        w365 = default
        w366 = default
      }
      on "PV-Current, mA" Value changed {
        Event Data() -> ("New Value"=w368)
        Number To Fractional String(number=w368) -> (F-format string=w369)
        Build Array("PV-Current", w369) -> w370
        call "Enqueue Message (Single).gvi"(message queue in=w294, message=$SendDoubleToCloud, message data=w370) -> (message queue out=w367, error out=w366)
        w365 = default
      }
      on "PV-LoadR,Ohm" Value changed {
        Event Data() -> ("New Value"=w371)
        Number To Fractional String(number=w371) -> (F-format string=w372)
        Build Array("PV-LoadR", w372) -> w373
        call "Enqueue Message (Single).gvi"(message queue in=w294, message=$SendDoubleToCloud, message data=w373) -> (message queue out=w367, error out=w366)
        w365 = default
      }
      on "PV-Voltage, V" Value changed {
        Event Data() -> ("New Value"=w374)
        Number To Fractional String(number=w374) -> (F-format string=w375)
        Build Array("PV-Voltage", w375) -> w376
        call "Enqueue Message (Single).gvi"(message queue in=w294, message=$SendDoubleToCloud, message data=w376) -> (message queue out=w367, error out=w366)
        w365 = default
      }
      on "PV-Temperature, ºC" Value changed {
        Event Data() -> ("New Value"=w377)
        Number To Fractional String(number=w377) -> (F-format string=w378)
        Build Array("PV-Temperature", w378) -> w379
        call "Enqueue Message (Single).gvi"(message queue in=w294, message=$SendDoubleToCloud, message data=w379) -> (message queue out=w367, error out=w366)
        w365 = default
      }
      on "PV-Temperature IR, ºC" Value changed {
        Event Data() -> ("New Value"=w380)
        Number To Fractional String(number=w380) -> (F-format string=w381)
        Build Array("PV-Temperature IR", w381) -> w382
        call "Enqueue Message (Single).gvi"(message queue in=w294, message=$SendDoubleToCloud, message data=w382) -> (message queue out=w367, error out=w366)
        w365 = default
      }
      on "PV-LightIntensity, W/m2" Value changed {
        Event Data() -> ("New Value"=w383)
        Number To Fractional String(number=w383) -> (F-format string=w384)
        Build Array("PV-LigthtIntensity", w384) -> w385
        call "Enqueue Message (Single).gvi"(message queue in=w294, message=$SendDoubleToCloud, message data=w385) -> (message queue out=w367, error out=w366)
        w365 = default
      }
      on "PV-LigthPower, %" Value changed {
        Event Data() -> ("New Value"=w386)
        Number To Fractional String(number=w386) -> (F-format string=w387)
        Build Array("PV-LigthtPower", w387) -> w388
        call "Enqueue Message (Single).gvi"(message queue in=w294, message=$SendDoubleToCloud, message data=w388) -> (message queue out=w367, error out=w366)
        w365 = default
      }
      on "PV-Panel Tilt Angle, º" Value changed {
        Event Data() -> ("New Value"=w389)
        Number To Fractional String(number=w389) -> (F-format string=w390)
        Build Array("PV-Panel Tilt Angle", w390) -> w391
        call "Enqueue Message (Single).gvi"(message queue in=w294, message=$SendDoubleToCloud, message data=w391) -> (message queue out=w367, error out=w366)
        w365 = default
      }
      on "PV-Panel Cofiguration" Value changed {
        Event Data() -> ("New Value"=w392)
        Build Array("PV-Panel Configuration", w392) -> w393
        call "Enqueue Message (Single).gvi"(message queue in=w294, message=$SendStringToCloud, message data=w393) -> (message queue out=w367, error out=w366)
        w365 = default
      }
      on "PV-Temperature IR Position" Value changed {
        Event Data() -> ("New Value"=w394)
        Build Array("PV-Temperature IR Position", w394) -> w395
        call "Enqueue Message (Single).gvi"(message queue in=w294, message=$SendStringToCloud, message data=w395) -> (message queue out=w367, error out=w366)
        w365 = default
      }
      on "PV-Cooling" Value changed {
        Event Data() -> ("New Value"=w396)
        Build Array("PV-Cooling", w396) -> w397
        call "Enqueue Message (Single).gvi"(message queue in=w294, message=$SendStringToCloud, message data=w397) -> (message queue out=w367, error out=w366)
        w365 = default
      }
      on "PV-Heating" Value changed {
        Event Data() -> ("New Value"=w398)
        Build Array("PV-Heating", w398) -> w399
        call "Enqueue Message (Single).gvi"(message queue in=w294, message=$SendStringToCloud, message data=w399) -> (message queue out=w367, error out=w366)
        w365 = default
      }
      on "PV-Optical Filter" Value changed {
        Event Data() -> ("New Value"=w400)
        Build Array("PV-Optical Filter", w400) -> w401
        call "Enqueue Message (Single).gvi"(message queue in=w294, message=$SendStringToCloud, message data=w401) -> (message queue out=w367, error out=w366)
        w365 = default
      }
      on "PV-LoadR1" Value changed {
        Event Data() -> ("New Value"=w402)
        Build Array("PV-LoadR1", w402) -> w403
        call "Enqueue Message (Single).gvi"(message queue in=w294, message=$SendStringToCloud, message data=w403) -> (message queue out=w367)
        w365 = default
        w366 = default
      }
      on "PV-LoadR2" Value changed {
        Event Data() -> ("New Value"=w404)
        Build Array("PV-LoadR2", w404) -> w405
        call "Enqueue Message (Single).gvi"(message queue in=w294, message=$SendStringToCloud, message data=w405) -> (message queue out=w367)
        w365 = default
        w366 = default
      }
      on "PV-LoadR3" Value changed {
        Event Data() -> ("New Value"=w406)
        Build Array("PV-LoadR3", w406) -> w407
        call "Enqueue Message (Single).gvi"(message queue in=w294, message=$SendStringToCloud, message data=w407) -> (message queue out=w367)
        w365 = default
        w366 = default
      }
      on "PV-LoadR4" Value changed {
        Event Data() -> ("New Value"=w408)
        Build Array("PV-LoadR4", w408) -> w409
        call "Enqueue Message (Single).gvi"(message queue in=w294, message=$SendStringToCloud, message data=w409) -> (message queue out=w367)
        w365 = default
        w366 = default
      }
      on "PV-LoadRTotal" Value changed {
        Event Data() -> ("New Value"=w410)
        Build Array("PV-LoadRTotal", w410) -> w411
        call "Enqueue Message (Single).gvi"(message queue in=w294, message=$SendStringToCloud, message data=w411) -> (message queue out=w367)
        w365 = default
        w366 = default
      }
    }
    call "Error Handler - Event Handling Loop.gvi"(message queue in=w367, error in=w366) -> (dup error in=w412)
    stop if w365
  }
  Unregister For Events(error in=w412, event registration refnum=s12) -> (error out=w413)
  Merge Errors(w413, w363) -> (error out=w414)
  Destroy User Event(error in=w414, user event=w291)
  disable {
    frame Enabled { }
    frame Disabled {
      call "Initialize.gvi"(device name="cam0") -> (session out=w415, error out=w416)
      call "Configure Grab.gvi"(session in=w415, error in=w416) -> (session out=w417, error out=w418)
      call "Create Image.gvi"(image name="image_1") -> (new image=w419)
      while {
        call "Grab.gvi"(session in=w417, error in=w418, image in=w419) -> (session out=w420, error out=w421)
        stop if $Stop
      }
      call "Close.gvi"(session=w420, error in=w421)
    }
  }
