vi "Main.gvi"   [LabVIEW NXG 5.0.0]
# This template is for the Queued Message Handler design pattern.
# The Event Handling Loop generates messages based on user interface actions.
# The Message Handling Loop processes messages generated by the Event Handling Loop, or by other messages.  The messages are string values, so new messages can be added easily to the Message Cases case structure in the Message Handling Loop.  Each message cluster can also provide an optional value for Message Data, which is a variant that can be converted to whatever message-specific data is required.
panel controls:
  "Exit": bool
  "TEMP Button": bool
  "LUX Button": bool
  "VISA Resource Name": "VISA Instr" = "COM5"
  "Initialize VISA": bool
  "CMD Button": bool
  "Initialize AI": bool
  "PV Config Button": bool
  "Set PV Angle Button": bool
  "IR Thermometer Config Button": bool
  "Fans Button": bool
  "Brightness Config Button": bool
  "Optic Filter Config Button": bool
  "Reset CVM Button": bool
  "Stop": bool
  "PV Config Selector": string
  "PV Angle": i32
  "Fans Selector": string
  "Optic Filter Selector": string
  "IR Thermometer Selector": string
  "Brightness": i32
  "Prepare CVM": bool
  "Command to Arduino": string = "@DO 34 0#"
  "Set LoadR": bool
  "Reset LoadR": bool
  "Total LoadR: R Values separated by coma": string
  "VAC Button": bool
  "Heat Selector": string
  "Heat Button": bool
  "Exit 2": bool
  "Do Something": bool
  "Do Something Else": bool
  "PV-Current, mA": f64
  "PV-LoadR,Ohm": f64
  "PV-Voltage, V": f64
  "PV-Temperature, ºC": f64
  "PV-LightIntensity, W/m2": f64
  "PV-Panel Tilt Angle, º": f64
  "PV-Panel Cofiguration": string
  "PV-Cooling": string
  "PV-Heating": string
  "PV-Optical Filter": string
  "PV-LoadR1": string
  "PV-LoadR2": string
  "PV-LoadR3": string
  "PV-LoadR4": string
  "Tab": i32
  "MeasuredData": f64[]
  "LoadR1": string
  "LoadR10": string
  "LoadR100": string
  "LoadR1000": string
panel indicators:
  "Display": string
  "Command reply": "ArduinoReply.gtype"
  "Reply LUX": "ArduinoReply.gtype"
  "Reply TEMP": "ArduinoReply.gtype"
  "AI measurements": waveform<f64>[]
  "Hardware Current Status": string
  "Voltage coeff": f64
  "Current coeff": f64
  "Recalculated Voltage": f64
  "Recalculated Current": f64
  "VAC Load Counter": i32
  "Voltage_Graph": f64[]
  "Output": error
  "VISA Answer_2": "ArduinoReply.gtype"[]
  "VISA Answer": "ArduinoReply.gtype"[]
  "Current_Graph": f64[]
  "VAC": cluster{"Element 1": f64[], "Element 2": f64[]}
  "Status PV Config": string
  "PV-Connecting Solar Panels": string
  "CMD TIME": "ArduinoReply.gtype"
  "MV-Panel Configuration": string
  "MV-Cooling": string
  "MV-Heating": string
  "MV-Optical Filter": string
  "MV-Panel Tilt Angle": string
  "MV-Light Power": string
  "MV-LoadR1": string
  "MV-LoadR2": string
  "MV-LoadR3": string
  "MV-LoadR4": string
  "API Key": string
  "Server URL": string
  "Status of Send to SystemLink Cycle": string
  "SendDoubleToCloud": string
  "SendStringToCloud": string
  "Error out Systemlink Read Cycle": error
  "Reply Arduino Status": "ArduinoReply.gtype"
  "Voltage MidPoint": f64
  "Current MidPoint": f64
  "Arduino Status": string
  "SendArrayDoubleToCloud": string
  "TempSensor": f64
  "LuxSensor": f64
  "TempSensor Reply": string
  "LuxSensor Reply": string
  "Connection Status": string
  "x = y?": bool
types:
  "ArduinoReply.gtype" = cluster{"Timestamp": timestamp, "DATA": string}
  T1 = cluster{"VISA Resource": "VISA Instr", "Physical Channel": "DAQmx Task"}
  "UI Data.gtype" = cluster{"Boolean": bool, "String": string, "Numeric": f64}
  "ValueRange.gtype" = cluster{"maximum value": f64, "minimum value": f64}
uses:
  NI::Skyline::Configuration::Open Configuration API Key.gvi
  NI::Skyline::TagHTTP::Query Tags.gvi
  NI::Skyline::TagHTTP::Open Tag.gvi
  NI::Skyline::TagHTTP::Read Tag (String).gvi
  NI::Skyline::TagHTTP::Close Tag (Single).gvi
  NI::Skyline::Configuration::Close Configuration.gvi
  Message Queue::Create All Message Queues.gvi
  Message Queue::Enqueue Message (Single).gvi
  Support::Error Handler - Event Handling Loop.gvi
  Message Queue::Dequeue Message.gvi
  NI::VISA::Configure Serial Port (Instr).gvi
  NI::VISA::Open (Instr).gvi
  NI::DAQmx::Internal::DAQmx Create Channel (AI-Voltage-Basic).gvi
  Queued Message Handler::Read_Write_VISA.gvi
  NI::DAQmx::Internal::DAQmx Read (Analog 2D DBL NChan NSamp).gvi
  NI::DAQmx::Internal::DAQmx Read (Analog 1D Wfm NChan NSamp).gvi
  Queued Message Handler::PV_switch.gvi
  Queued Message Handler::CMD_Iteration.gvi
  NI::G Core::Error::Display Error.gvi
  NI::DAQmx::Internal::DAQmx Stop Task.gvi
  NI::VISA::Close (Instr).gvi
  NI::G Core::Error::Build Error Cluster.gvi
  Support::Error Handler - Message Handling Loop.gvi
  NI::Skyline::TagHTTP::Write Tag (DBL).gvi
  NI::Skyline::TagHTTP::Write Tag (String).gvi
  NI::Vision::IMAQdx::Initialize.gvi
  NI::Vision::IMAQdx::Configure Grab.gvi
  NI::Vision::Core::Basics::Create Image.gvi
  NI::Vision::IMAQdx::Grab.gvi
  NI::Vision::IMAQdx::Close.gvi
diagram:
  $"MV-Panel Configuration" <- ""
  $"MV-Cooling" <- ""
  $"MV-Heating" <- ""
  $"MV-Optical Filter" <- ""
  $"MV-Panel Tilt Angle" <- ""
  $"MV-Light Power" <- ""
  $"MV-LoadR1" <- ""
  $"MV-LoadR2" <- ""
  $"MV-LoadR3" <- ""
  $"MV-LoadR4" <- ""
  Array Size(array=["MV-Panels Configuration"]) -> (size(s)=w1)
  Initialize Array(element=1904-12-31T23:00:00Z, size=w1) -> w2
  sequence {
    frame 0 {
      Wait(time to wait=20000)
    }
  }
  s1 = w2  # shift register
  while {
    Wait(time to wait=500)
    call "Open Configuration API Key.gvi"(server url=$"Server URL", api key=$"API Key") -> (configuration=w3, error out=w4)
    call "Query Tags.gvi"(paths=["MV-Panels Configuration"], error in=w4, configuration=w3) -> (tags=w5, error out=w6)
    Build Array(reference to "MV-Panel Configuration", reference to "MV-Cooling", reference to "MV-Heating", reference to "MV-Optical Filter", reference to "MV-Panel Tilt Angle", reference to "MV-Light Power", reference to "MV-LoadR1", reference to "MV-LoadR2", reference to "MV-LoadR3", reference to "MV-LoadR4") -> w7
    for {
      w8 = each element of w5
      w9 = each element of s1
      w10 = each element of w7
      Property Node(instance in=w8) -> ("Path"=w12, "Datatype"=w13)
      call "Open Tag.gvi"(path=w12, data type=w13, error in=w6, configuration=w3) -> (tag=w14, error out=w15)
      call "Read Tag (String).gvi"(tag in=w14, error in=w15) -> (value=w16, time stamp=w17, error out=w18)
      Is Greater(x=w17, y=w9) -> w19
      case (w19) {
        frame False, Default { }
        frame True {
          Property Node(instance in=w10, "ValueSignaling"=w16)
        }
      }
      append w17 to w11
    }
    for {
      w20 = each element of w5
      call "Close Tag (Single).gvi"(tag=w20, error in=w18) -> (error out=w21)
    }
    call "Close Configuration.gvi"(configuration=w3, error in=w21) -> (error out=w22)
    $"Error out Systemlink Read Cycle" <- w22
    next s1 = w11
    stop if $"Exit 2"
  }
  $"PV-Connecting Solar Panels" <- ""
  disable {
    frame Enabled { }
    frame Disabled {
      Destroy User Event()
    }
  }
  w23 = bool FALSE  # Stop Event
  Create User Event[EventName="Stop Event"](user event data type=w23) -> (error out=w24, user event out=w25)
  Register For Events("Stop Event"=w25) -> (event registration refnum out=w26)
  call "Create All Message Queues.gvi"(error in=w24) -> (message queues=w27, error out=w28)
  Property Node(instance in=w27) -> ("UI"=w29)
  s2 = w26  # shift register
  while {
    event (dynamic events = s2) {
      on "Exit" Value changed {
        call "Enqueue Message (Single).gvi"(priority message=TRUE, message queue in=w29, message="Exit") -> (message queue out=w32, error out=w31)
        w30 = default
      }
      on dynamic event 0 {
        $Display <- "\"Exit\" button pressed"
        w30 = TRUE
        w31 = default
        w32 = w29
      }
      on "Window" Close? {
        call "Enqueue Message (Single).gvi"(priority message=TRUE, message queue in=w29, message="Exit") -> (message queue out=w32)
        Event Filter("Discard?"=TRUE)
        w30 = default
        w31 = default
      }
      on "Initialize VISA" Value changed {
        call "Enqueue Message (Single).gvi"(message queue in=w29, message="Initialize VISA") -> (message queue out=w32, error out=w31)
        w30 = default
      }
      on "Initialize AI" Value changed {
        call "Enqueue Message (Single).gvi"(message queue in=w29, message="Initialize AI") -> (message queue out=w32, error out=w31)
        w30 = default
      }
      on "CMD Button" Value changed {
        call "Enqueue Message (Single).gvi"(message queue in=w29, message="Send CMD") -> (message queue out=w32, error out=w31)
        w30 = default
      }
      on "TEMP Button" Value changed {
        call "Enqueue Message (Single).gvi"(message queue in=w29, message="Get Temperature") -> (message queue out=w32, error out=w31)
        w30 = default
      }
      on "LUX Button" Value changed {
        call "Enqueue Message (Single).gvi"(message queue in=w29, message="Get Brightness") -> (message queue out=w32, error out=w31)
        w30 = default
      }
      on "Reset CVM Button" Value changed {
        call "Enqueue Message (Single).gvi"(message queue in=w29, message="Reset CVM") -> (message queue out=w32, error out=w31)
        w30 = default
      }
      on "PV Config Button" Value changed {
        call "Enqueue Message (Single).gvi"(message queue in=w29, message="PV Config", message data=$"PV Config Selector") -> (message queue out=w32, error out=w31)
        w30 = default
      }
      on "MV-Panel Configuration" Value changed {
        call "Enqueue Message (Single).gvi"(message queue in=w29, message="PV Config", message data=$"MV-Panel Configuration") -> (message queue out=w32, error out=w31)
        w30 = default
      }
      on "Heat Button" Value changed {
        call "Enqueue Message (Single).gvi"(message queue in=w29, message="Heat Config", message data=$"Heat Selector") -> (message queue out=w32, error out=w31)
        w30 = default
      }
      on "Set PV Angle Button" Value changed {
        call "Enqueue Message (Single).gvi"(message queue in=w29, message="Set PV Angle", message data=$"PV Angle") -> (message queue out=w32, error out=w31)
        w30 = default
      }
      on "IR Thermometer Config Button" Value changed {
        call "Enqueue Message (Single).gvi"(message queue in=w29, message="IR Thermometer", message data=$"IR Thermometer Selector") -> (message queue out=w32, error out=w31)
        w30 = default
      }
      on "Fans Button" Value changed {
        call "Enqueue Message (Single).gvi"(message queue in=w29, message="Fans Control", message data=$"Fans Selector") -> (message queue out=w32, error out=w31)
        w30 = default
      }
      on "Brightness Config Button" Value changed {
        call "Enqueue Message (Single).gvi"(message queue in=w29, message="Brightness Config", message data=$Brightness) -> (message queue out=w32, error out=w31)
        w30 = default
      }
      on "Optic Filter Config Button" Value changed {
        call "Enqueue Message (Single).gvi"(message queue in=w29, message="Optic Filter Config", message data=$"Optic Filter Selector") -> (message queue out=w32, error out=w31)
        w30 = default
      }
      on "Prepare CVM" Value changed {
        call "Enqueue Message (Single).gvi"(message queue in=w29, message="Prepare CVM") -> (message queue out=w32, error out=w31)
        w30 = default
      }
      on "Set LoadR" Value changed {
        Concatenate Strings($LoadR1, $LoadR10, $LoadR100, $LoadR1000) -> w33
        call "Enqueue Message (Single).gvi"(message queue in=w29, message="Set Resistance", message data=w33) -> (message queue out=w32, error out=w31)
        w30 = default
      }
      on "Reset LoadR" Value changed {
        call "Enqueue Message (Single).gvi"(message queue in=w29, message="Reset Resistance") -> (message queue out=w32, error out=w31)
        w30 = default
      }
      on "VAC Button" Value changed {
        Property Node(instance in=reference to "VAC")
        Get Current Time() -> (current time=w34)
        call "Enqueue Message (Single).gvi"(message queue in=w29, message="VAC", message data=w34) -> (message queue out=w32)
        $"VAC Load Counter" <- 0
        w30 = default
        w31 = default
      }
    }
    call "Error Handler - Event Handling Loop.gvi"(message queue in=w32, error in=w31) -> (dup error in=w35)
    stop if w30
  }
  Unregister For Events(error in=w35, event registration refnum=s2)
  $"API Key" <- "zYUbuW0YNkg1G__lXfJiGVBNWME-HlVd2a5NUHp-IP"
  s3 = "UI Data.gtype" {all zero or empty}  # shift register
  s4 = T1 {"VISA Resource"="COM5", "Physical Channel"=""}  # shift register
  while {
    call "Dequeue Message.gvi"(message queue in=w29, error in=w28) -> (message queue out=w36, message=w37, message data=w38, error out=w39)
    $"Hardware Current Status" <- w37
    # s3: Data
    # w25: Stop Event
    case (w37) ignore case {  # Message Cases
      frame "Initialize" {
        call "Enqueue Message (Single).gvi"(message queue in=w36, message="Initialize VISA", error in=w39) -> (message queue out=w44, error out=w45)
        call "Enqueue Message (Single).gvi"(message queue in=w44, message="Initialize AI", error in=w45) -> (message queue out=w46, error out=w47)
        call "Enqueue Message (Single).gvi"(message queue in=w46, message="Set Time", error in=w47) -> (message queue out=w48, error out=w49)
        # set time
        #
        # NO initialase SLC
        disable {
          frame Enabled {
            w50 = default
            w51 = default
          }
          frame Disabled {
            call "Enqueue Message (Single).gvi"(message queue in=w48, message="Reset CVM", error in=w49) -> (message queue out=w52, error out=w53)
            call "Enqueue Message (Single).gvi"(message queue in=w52, message="Fans Control", message data="Turn All Off", error in=w53) -> (message queue out=w54, error out=w55)
            call "Enqueue Message (Single).gvi"(message queue in=w54, message="Heat Config", message data="No Heat", error in=w55) -> (message queue out=w56, error out=w57)
            call "Enqueue Message (Single).gvi"(message queue in=w56, message="Optic Filter Config", message data="None", error in=w57) -> (message queue out=w58, error out=w59)
            call "Enqueue Message (Single).gvi"(message queue in=w58, message="IR Thermometer", message data="None", error in=w59) -> (message queue out=w60, error out=w61)
            call "Enqueue Message (Single).gvi"(message queue in=w60, message="Set PV Angle", message data=90, error in=w61) -> (message queue out=w62, error out=w63)
            call "Enqueue Message (Single).gvi"(message queue in=w62, message="PV Config", message data="Parallel 4", error in=w63) -> (message queue out=w50, error out=w51)
          }
        }
        call "Enqueue Message (Single).gvi"(message queue in=w50, message="Wait For Event", error in=w51) -> (error out=w40)
        w41 = s3
        w42 = default
        w43 = s4
      }
      frame "Initialize VISA" {
        call "Configure Serial Port (Instr).gvi"(stop bits="1.0"(10), session in=$"VISA Resource Name", baud rate=115200, parity="None"(0), termination char=0xA, enable termination char=TRUE) -> (session out=w64, error out=w65)
        call "Open (Instr).gvi"(resource name=w64, error in=w65) -> (session out=w66, error out=w67)
        Property Node(instance in=s4, "VISA Resource"=w66) -> (instance out=w43)
        Wait(time to wait=2000)
        Merge Errors(w67, w39) -> (error out=w40)
        w41 = s3
        w42 = default
      }
      frame "Initialize AI" {
        call "DAQmx Create Channel (AI-Voltage-Basic).gvi"(error in=w39, physical channels="Dev1/ai0:1,Dev1/ai3,Dev1/ai7", units="Volts"(10348), measurement range="ValueRange.gtype" {"maximum value"=10, "minimum value"=0}, input terminal configuration="RSE"(10083)) -> (task out=w68, error out=w40)
        Property Node(instance in=s4, "Physical Channel"=w68) -> (instance out=w43)
        w41 = s3
        w42 = default
      }
      frame "Wait For Event" {
        call "Enqueue Message (Single).gvi"(message queue in=w36, message="Watchdog", error in=w39) -> (error out=w40)
        w41 = s3
        w42 = default
        w43 = s4
      }
      frame "Send CMD" {
        Property Node(instance in=s4) -> ("VISA Resource"=w69, instance out=w43)
        call "Enqueue Message (Single).gvi"(message queue in=w36, message="Wait For Event", error in=w39) -> (error out=w70)
        call "Read_Write_VISA.gvi"(VISA_IN=w69, CMD=$"Command to Arduino", ERROR_IN=w70) -> (Arduino_Reply=w71, ERROR_OUT=w40)
        $"Command reply" <- w71
        w41 = s3
        w42 = default
      }
      frame "Set Time" {
        call "Enqueue Message (Single).gvi"(message queue in=w36, message="Wait For Event", error in=w39) -> (error out=w72)
        Property Node(instance in=s4) -> ("VISA Resource"=w73, instance out=w43)
        call "Read_Write_VISA.gvi"(VISA_IN=w73, CMD="@TIME 10 CEPHEI#", ERROR_IN=w72) -> (Arduino_Reply=w74, ERROR_OUT=w40)
        $"CMD TIME" <- w74
        w41 = s3
        w42 = default
      }
      frame "Watchdog" {
        Property Node(instance in=s4) -> ("Physical Channel"=w75, "VISA Resource"=w76, instance out=w43)
        call "Read_Write_VISA.gvi"(VISA_IN=w76, CMD="@TIME 10 ?#", ERROR_IN=w39) -> (OUTPUT=w77, Arduino_Reply=w78, ERROR_OUT=w79)
        case (TRUE) {
          frame False, Default {
            call "Enqueue Message (Single).gvi"(message queue in=w36, message="Initialize", error in=w79) -> (error out=w40)
          }
          frame True {
            call "Read_Write_VISA.gvi"(VISA_IN=w77, CMD="@LUX 10 1#", ERROR_IN=w79) -> (OUTPUT=w80, Arduino_Reply=w81, ERROR_OUT=w82)
            call "Read_Write_VISA.gvi"(VISA_IN=w80, CMD="@TEMP 8 0#", ERROR_IN=w82) -> (Arduino_Reply=w83, ERROR_OUT=w84)
            call "DAQmx Read (Analog 2D DBL NChan NSamp).gvi"(task in=w75, error in=w84, number of samples per channel=1) -> (error out=w85, data=w86)
            Array Index(array=w86) -> (out0[1, 0]=w87, out1[2, 0]=w88)
            Multiply(w87, 4) -> w89
            Multiply(w89, $"Voltage coeff") -> w90
            Feedback Node(input=w91) -> w92
            Build Array(w92, w90) -> w91
            $Voltage_Graph <- w91
            $"Recalculated Voltage" <- w90
            $"Voltage MidPoint" <- w88
            Array Index(array=w86) -> (out0[0, 0]=w93, out1[3, 0]=w94)
            Divide(x=w93, y=70) -> w95
            Multiply(w95, 1000) -> w96
            Multiply(w96, $"Current coeff") -> w97
            Feedback Node(input=w98) -> w99
            Build Array(w99, w97) -> w98
            $Current_Graph <- w98
            $"Recalculated Current" <- w97
            $"Current MidPoint" <- w94
            call "DAQmx Read (Analog 1D Wfm NChan NSamp).gvi"(task in=w75, error in=w85, number of samples per channel=1) -> (error out=w100, data=w101)
            call "Enqueue Message (Single).gvi"(message queue in=w36, message="Wait For Event", error in=w100) -> (error out=w40)
            $"AI measurements" <- w101
            Property Node(instance in=w83) -> ("DATA"=w102, instance out=w103)
            $"Reply TEMP" <- w103
            $"TempSensor Reply" <- w102
            Property Node(instance in=w81) -> ("DATA"=w104, instance out=w105)
            $"Reply LUX" <- w105
            Floating Point String To Number(offset=10, string=w102, use system decimal point (T)=FALSE) -> (number=w106)
            $TempSensor <- w106
            $"LuxSensor Reply" <- w104
            Floating Point String To Number(offset=10, string=w104) -> (number=w107)
            $LuxSensor <- w107
            Build Array(w90, w97, w106, w107) -> w108
            $MeasuredData <- w108
          }
        }
        Property Node(instance in=w78) -> ("DATA"=w109, instance out=w110)
        $"Reply Arduino Status" <- w110
        $"Arduino Status" <- w109
        s5 = w109  # shift register
        while {
          Match Pattern(regular expression=" ", string=s5) -> (after substring=w111, before substring=w112)
          Is Empty String Or Path(string/path=w111) -> w113
          next s5 = w111
          stop if w113
        }
        $"Connection Status" <- w112
        Is Equal(x=w112, y="CEPHEI") -> w114
        $"x = y?" <- w114
        w41 = s3
        w42 = default
      }
      frame "PV Config" {
        Variant To Data(error in (no error)=w39, type=string "", variant=w38) -> (data=w115, error out=w116)
        Property Node(instance in=s4) -> ("VISA Resource"=w117, instance out=w43)
        call "PV_switch.gvi"(VISA_IN=w117, CTRL="Disconnect", ERROR_IN=w116) -> (VISA_OUT=w118, ERROR_OUT=w119)
        case (w115) {
          frame "Single" {
            w123 = ["@DO 17 0#", "@DO 18 1#", "@DO 23 1#", "@DO 24 1#", "@DO 25 1#", "@DO 26 0#", "@DO 27 0#", "@DO 28 0#", "@DO 29 1#", "@DO 30 1#", "@DO 31 1#", "@DO 32 1#", "@DO 33 0#"]
            w124 = ["@DO 54 1#", "@DO 55 1#", "@DO 56 1#", "@DO 57 1#", "@DO 58 1#", "@DO 59 1#", "@DO 60 1#", "@DO 61 1#"]
            # @DO 17 0#
            # @DO 18 1#
            # @DO 23 1#
            # @DO 24 1#
            # @DO 25 1#
            # @DO 26 0#
            # @DO 27 0#
            # @DO 28 0#
            # @DO 29 1#
            # @DO 30 1#
            # @DO 31 1#
            # @DO 32 1#
            # @DO 33 0#
            #
            # 03,08,2020
            # 19:51
            Insert Into Array(inArray=w123, new=w124) -> w125
            call "CMD_Iteration.gvi"(VISA_IN=w118, ARRAY_IN=w125, ERROR_IN=w119) -> (VISA Answer=w121, ERROR_OUT=w120)
            w122 = w115
          }
          frame "Parallel 2" {
            # @DO 17 1#
            # @DO 18 0#
            # @DO 23 1#
            # @DO 24 0#
            # @DO 25 1#
            # @DO 26 1#
            # @DO 27 1#
            # @DO 28 1#
            # @DO 29 1#
            # @DO 30 1#
            # @DO 31 1#
            # @DO 32 1#
            # @DO 33 1#
            #
            # 03.08.2020
            # 19.53
            w126 = ["@DO 17 1#", "@DO 18 0#", "@DO 23 1#", "@DO 24 0#", "@DO 25 1#", "@DO 26 1#", "@DO 27 1#", "@DO 28 1#", "@DO 29 1#", "@DO 30 1#", "@DO 31 1#", "@DO 32 1#", "@DO 33 1#"]
            # Disconnect all Diodes
            w127 = ["@DO 54 1#", "@DO 55 1#", "@DO 56 1#", "@DO 57 1#", "@DO 58 1#", "@DO 59 1#", "@DO 60 1#", "@DO 61 1#"]
            Insert Into Array(inArray=w126, new=w127) -> w128
            call "CMD_Iteration.gvi"(VISA_IN=w118, ARRAY_IN=w128, ERROR_IN=w119) -> (VISA Answer=w121, ERROR_OUT=w120)
            w122 = w115
          }
          frame "Parallel 2 Diode" {
            # @DO 17 1#
            # @DO 18 0#
            # @DO 23 1#
            # @DO 24 0#
            # @DO 25 1#
            # @DO 26 1#
            # @DO 27 1#
            # @DO 28 1#
            # @DO 29 1#
            # @DO 30 1#
            # @DO 31 1#
            # @DO 32 1#
            # @DO 33 1#
            #
            # 03.08.2020
            # 19.54
            w129 = ["@DO 17 1#", "@DO 18 0#", "@DO 23 1#", "@DO 24 0#", "@DO 25 1#", "@DO 26 1#", "@DO 27 1#", "@DO 28 1#", "@DO 29 1#", "@DO 30 1#", "@DO 31 1#", "@DO 32 1#", "@DO 33 1#"]
            # @DO 56 0#
            # @DO 57 0#
            #
            # 19.54
            w130 = ["@DO 54 1#", "@DO 55 1#", "@DO 56 0#", "@DO 57 0#", "@DO 58 1#", "@DO 59 1#", "@DO 60 1#", "@DO 61 1#"]
            Insert Into Array(inArray=w129, new=w130) -> w131
            call "CMD_Iteration.gvi"(VISA_IN=w118, ARRAY_IN=w131, ERROR_IN=w119) -> (VISA Answer=w121, ERROR_OUT=w120)
            w122 = w115
          }
          frame "Series 2" {
            # @DO 17 0#
            # @DO 18 1#
            # @DO 23 1#
            # @DO 24 0#
            # @DO 25 1#
            # @DO 26 1#
            # @DO 27 1#
            # @DO 28 1#
            # @DO 29 0#
            # @DO 30 1#
            # @DO 31 1#
            # @DO 32 0#
            # @DO 33 0#
            #
            # 03.08.2020
            # 19.55
            w132 = ["@DO 17 0#", "@DO 18 1#", "@DO 23 1#", "@DO 24 0#", "@DO 25 1#", "@DO 26 1#", "@DO 27 1#", "@DO 28 1#", "@DO 29 0#", "@DO 30 1#", "@DO 31 1#", "@DO 32 0#", "@DO 33 0#"]
            w133 = ["@DO 54 1#", "@DO 55 1#", "@DO 56 1#", "@DO 57 1#", "@DO 58 1#", "@DO 59 1#", "@DO 60 1#", "@DO 61 1#"]
            Insert Into Array(inArray=w132, new=w133) -> w134
            call "CMD_Iteration.gvi"(VISA_IN=w118, ARRAY_IN=w134, ERROR_IN=w119) -> (VISA Answer=w121, ERROR_OUT=w120)
            w122 = w115
          }
          frame "Series 2 Diode" {
            # @DO 17 0#
            # @DO 18 1#
            # @DO 23 1#
            # @DO 24 0#
            # @DO 25 1#
            # @DO 26 1#
            # @DO 27 1#
            # @DO 28 1#
            # @DO 29 0#
            # @DO 30 1#
            # @DO 31 1#
            # @DO 32 0#
            # @DO 33 0#
            #
            # 03.08.2020
            # 19.57
            w135 = ["@DO 17 0#", "@DO 18 1#", "@DO 23 1#", "@DO 24 0#", "@DO 25 1#", "@DO 26 1#", "@DO 27 1#", "@DO 28 1#", "@DO 29 0#", "@DO 30 1#", "@DO 31 1#", "@DO 32 0#", "@DO 33 0#"]
            # @DO 60 0#
            # @DO 61 0#
            #
            # 03.08.2020
            w136 = ["@DO 54 1#", "@DO 55 1#", "@DO 56 1#", "@DO 57 1#", "@DO 58 1#", "@DO 59 1#", "@DO 60 0#", "@DO 61 0#"]
            Insert Into Array(inArray=w135, new=w136) -> w137
            call "CMD_Iteration.gvi"(VISA_IN=w118, ARRAY_IN=w137, ERROR_IN=w119) -> (VISA Answer=w121, ERROR_OUT=w120)
            w122 = w115
          }
          frame "Parallel 4", Default {
            # @DO 17 1#
            # @DO 18 1#
            # @DO 23 1#
            # @DO 24 1#
            # @DO 25 1#
            # @DO 26 1#
            # @DO 27 1#
            # @DO 28 1#
            # @DO 29 1#
            # @DO 30 1#
            # @DO 31 1#
            # @DO 32 1#
            # @DO 33 1#
            #
            # 03.08.2020
            # 19.59
            w138 = ["@DO 17 1#", "@DO 18 1#", "@DO 23 1#", "@DO 24 1#", "@DO 25 1#", "@DO 26 1#", "@DO 27 1#", "@DO 28 1#", "@DO 29 1#", "@DO 30 1#", "@DO 31 1#", "@DO 32 1#", "@DO 33 1#"]
            w139 = ["@DO 54 1#", "@DO 55 1#", "@DO 56 1#", "@DO 57 1#", "@DO 58 1#", "@DO 59 1#", "@DO 60 1#", "@DO 61 1#"]
            Insert Into Array(inArray=w138, new=w139) -> w140
            call "CMD_Iteration.gvi"(VISA_IN=w118, ARRAY_IN=w140, ERROR_IN=w119) -> (VISA Answer=w121, ERROR_OUT=w120)
            w122 = w115
          }
          frame "Parallel 4 Diode" {
            # @DO 17 1#
            # @DO 18 1#
            # @DO 23 1#
            # @DO 24 1#
            # @DO 25 1#
            # @DO 26 1#
            # @DO 27 1#
            # @DO 28 1#
            # @DO 29 1#
            # @DO 30 1#
            # @DO 31 1#
            # @DO 32 1#
            # @DO 33 1#
            # 03.08.2020
            # 20.00
            w141 = ["@DO 17 1#", "@DO 18 1#", "@DO 23 1#", "@DO 24 1#", "@DO 25 1#", "@DO 26 1#", "@DO 27 1#", "@DO 28 1#", "@DO 29 1#", "@DO 30 1#", "@DO 31 1#", "@DO 32 1#", "@DO 33 1#"]
            # @DO 54 0#
            # @DO 55 0#
            # @DO 56 0#
            # @DO 57 0#
            #
            # 03.08.2020
            # 20.00
            w142 = ["@DO 54 0#", "@DO 55 0#", "@DO 56 0#", "@DO 57 0#", "@DO 58 1#", "@DO 59 1#", "@DO 60 1#", "@DO 61 1#"]
            Insert Into Array(inArray=w141, new=w142) -> w143
            call "CMD_Iteration.gvi"(VISA_IN=w118, ARRAY_IN=w143, ERROR_IN=w119) -> (VISA Answer=w121, ERROR_OUT=w120)
            w122 = w115
          }
          frame "Series 4" {
            # @DO 17 0#
            # @DO 18 1#
            # @DO 23 0#
            # @DO 24 1#
            # @DO 25 1#
            # @DO 26 0#
            # @DO 27 0#
            # @DO 28 0#
            # @DO 29 0#
            # @DO 30 0#
            # @DO 31 0#
            # @DO 32 0#
            # @DO 33 0#
            #
            # 03.08.2020
            # 20.02
            w144 = ["@DO 17 0#", "@DO 18 1#", "@DO 23 0#", "@DO 24 1#", "@DO 25 1#", "@DO 26 0#", "@DO 27 0#", "@DO 28 0#", "@DO 29 0#", "@DO 30 0#", "@DO 31 0#", "@DO 32 0#", "@DO 33 0#"]
            w145 = ["@DO 54 1#", "@DO 55 1#", "@DO 56 1#", "@DO 57 1#", "@DO 58 1#", "@DO 59 1#", "@DO 60 1#", "@DO 61 1#"]
            Insert Into Array(inArray=w144, new=w145) -> w146
            call "CMD_Iteration.gvi"(VISA_IN=w118, ARRAY_IN=w146, ERROR_IN=w119) -> (VISA Answer=w121, ERROR_OUT=w120)
            w122 = w115
          }
          frame "Series 4 Diode" {
            # @DO 17 0#
            # @DO 18 1#
            # @DO 23 0#
            # @DO 24 1#
            # @DO 25 1#
            # @DO 26 0#
            # @DO 27 0#
            # @DO 28 0#
            # @DO 29 0#
            # @DO 30 0#
            # @DO 31 0#
            # @DO 32 0#
            # @DO 33 0#
            #
            # 03.08.2020
            # 20.03
            w147 = ["@DO 17 0#", "@DO 18 1#", "@DO 23 0#", "@DO 24 1#", "@DO 25 1#", "@DO 26 0#", "@DO 27 0#", "@DO 28 0#", "@DO 29 0#", "@DO 30 0#", "@DO 31 0#", "@DO 32 0#", "@DO 33 0#"]
            # @DO 58 0#
            # @DO 59 0#
            # @DO 60 0#
            # @DO 61 0#
            #
            # 03.08.2020
            # 20.04
            w148 = ["@DO 54 1#", "@DO 55 1#", "@DO 56 1#", "@DO 57 1#", "@DO 58 0#", "@DO 59 0#", "@DO 60 0#", "@DO 61 0#"]
            Insert Into Array(inArray=w147, new=w148) -> w149
            call "CMD_Iteration.gvi"(VISA_IN=w118, ARRAY_IN=w149, ERROR_IN=w119) -> (VISA Answer=w121, ERROR_OUT=w120)
            w122 = w115
          }
          frame "Parallel Of Series" {
            # @DO 17 1#
            # @DO 18 1#
            # @DO 23 1#
            # @DO 24 1#
            # @DO 25 1#
            # @DO 26 1#
            # @DO 27 0#
            # @DO 28 1#
            # @DO 29 0#
            # @DO 30 0#
            # @DO 31 1#
            # @DO 32 0#
            # @DO 33 1#
            #
            # 03.08.2020
            # 20.05
            w150 = ["@DO 17 1#", "@DO 18 1#", "@DO 23 1#", "@DO 24 1#", "@DO 25 1#", "@DO 26 1#", "@DO 27 0#", "@DO 28 1#", "@DO 29 0#", "@DO 30 0#", "@DO 31 1#", "@DO 32 0#", "@DO 33 1#"]
            w151 = ["@DO 54 1#", "@DO 55 1#", "@DO 56 1#", "@DO 57 1#", "@DO 58 1#", "@DO 59 1#", "@DO 60 1#", "@DO 61 1#"]
            Insert Into Array(inArray=w150, new=w151) -> w152
            call "CMD_Iteration.gvi"(VISA_IN=w118, ARRAY_IN=w152, ERROR_IN=w119) -> (VISA Answer=w121, ERROR_OUT=w120)
            w122 = w115
          }
          frame "Parallel Of Series Diode" {
            # @DO 17 1#
            # @DO 18 1#
            # @DO 23 1#
            # @DO 24 1#
            # @DO 25 1#
            # @DO 26 1#
            # @DO 27 0#
            # @DO 28 1#
            # @DO 29 0#
            # @DO 30 0#
            # @DO 31 1#
            # @DO 32 0#
            # @DO 33 1#
            #
            # 03.08.2020
            # 20.06
            # @DO 58 0#
            # @DO 59 0#
            # @DO 60 0#
            # @DO 61 0#
            #
            # 03.08.2020
            # 20.097
            w153 = ["@DO 17 1#", "@DO 18 1#", "@DO 23 1#", "@DO 24 1#", "@DO 25 1#", "@DO 26 1#", "@DO 27 0#", "@DO 28 1#", "@DO 29 0#", "@DO 30 0#", "@DO 31 1#", "@DO 32 0#", "@DO 33 1#"]
            w154 = ["@DO 54 1#", "@DO 55 1#", "@DO 56 1#", "@DO 57 1#", "@DO 58 0#", "@DO 59 0#", "@DO 60 0#", "@DO 61 0#"]
            Insert Into Array(inArray=w153, new=w154) -> w155
            call "CMD_Iteration.gvi"(VISA_IN=w118, ARRAY_IN=w155, ERROR_IN=w119) -> (VISA Answer=w121, ERROR_OUT=w120)
            w122 = w115
          }
          frame "Series Of Parallel" {
            w156 = ["@DO 54 1#", "@DO 55 1#", "@DO 56 1#", "@DO 57 1#", "@DO 58 1#", "@DO 59 1#", "@DO 60 1#", "@DO 61 1#"]
            # @DO 17 1#
            # @DO 18 0#
            # @DO 23 0#
            # @DO 24 0#
            # @DO 25 0#
            # @DO 26 1#
            # @DO 27 1#
            # @DO 28 1#
            # @DO 29 1#
            # @DO 30 1#
            # @DO 31 1#
            # @DO 32 1#
            # @DO 33 1#
            #
            # 03.08.2020
            # 20.07
            w157 = ["@DO 17 1#", "@DO 18 0#", "@DO 23 0#", "@DO 24 0#", "@DO 25 0#", "@DO 26 1#", "@DO 27 1#", "@DO 28 1#", "@DO 29 1#", "@DO 30 1#", "@DO 31 1#", "@DO 32 1#", "@DO 33 1#"]
            Insert Into Array(inArray=w157, new=w156) -> w158
            call "CMD_Iteration.gvi"(VISA_IN=w118, ARRAY_IN=w158, ERROR_IN=w119) -> (VISA Answer=w121, ERROR_OUT=w120)
            w122 = w115
          }
          frame "Series Of Parallel Diode" {
            # @DO 17 1#
            # @DO 18 0#
            # @DO 23 0#
            # @DO 24 0#
            # @DO 25 0#
            # @DO 26 1#
            # @DO 27 1#
            # @DO 28 1#
            # @DO 29 1#
            # @DO 30 1#
            # @DO 31 1#
            # @DO 32 1#
            # @DO 33 1#
            #
            # 03.08.2020
            # 20.08
            w159 = ["@DO 17 1#", "@DO 18 0#", "@DO 23 0#", "@DO 24 0#", "@DO 25 0#", "@DO 26 1#", "@DO 27 1#", "@DO 28 1#", "@DO 29 1#", "@DO 30 1#", "@DO 31 1#", "@DO 32 1#", "@DO 33 1#"]
            # @DO 54 0#
            # @DO 55 0#
            # @DO 56 0#
            # @DO 57 0#
            #
            # 20.09
            # 03.08.2020
            w160 = ["@DO 54 0#", "@DO 55 0#", "@DO 56 0#", "@DO 57 0#", "@DO 58 1#", "@DO 59 1#", "@DO 60 1#", "@DO 61 1#"]
            Insert Into Array(inArray=w159, new=w160) -> w161
            call "CMD_Iteration.gvi"(VISA_IN=w118, ARRAY_IN=w161, ERROR_IN=w119) -> (VISA Answer=w121, ERROR_OUT=w120)
            w122 = w115
          }
        }
        call "PV_switch.gvi"(VISA_IN=w117, CTRL="Connect", ERROR_IN=w120) -> (ERROR_OUT=w40)
        case (w40) {
          frame Error, Default { }
          frame No Error {
            $"Status PV Config" <- w122
            Property Node(instance in=reference to "PV-Panel Cofiguration", "ValueSignaling"=w122)
          }
        }
        $"VISA Answer" <- w121
        w41 = s3
        w42 = default
      }
      frame "Prepare CVM" {
        Property Node(instance in=s4) -> ("VISA Resource"=w162, "Physical Channel"=w163, instance out=w43)
        call "DAQmx Read (Analog 2D DBL NChan NSamp).gvi"(task in=w163, error in=w39, number of samples per channel=1) -> (error out=w164, data=w165)
        Array Index(array=w165) -> (out0[2, 0]=w166)
        Multiply(w166, 4) -> w167
        C Code Node("x"=w167, Error In=w164) -> ("y"=w168, Error Out=w169)
        ~~~
        if(x>-1 && x<=1)
          y = 0;
        if(x>1 && x<=10)
          y = 1;
        if(x>10 && x<=20)
          y = 2;
        if(x>20 && x<=30)
          y = 3;
        ~~~
        Array Index(array=w165) -> (out0[3, 0]=w170)
        # Tip For Local Wiring Solution
        # Relay 1(50) 	DO 1- REP A x1
        # 		DO 0- AMP A x10
        #
        # Relay 2(51) 	DO 1-REP V x1
        # 		DO 0-DIV V x0.25
        # Relay 3(52) 	DO 1-REP V x1
        # 		DO 0-DIV V x0.5
        # Relay 4(53) 	DO 1-REP V x1
        # 		DO 0-AMP V x10
        C Code Node("x"=w170, Error In=w169) -> ("y"=w171, Error Out=w172)
        ~~~
        if(x>-1 && x<=0.6)
          y = 0;
        if(x>0.6 && x<=6)
          y = 1;
        ~~~
        # Voltage Range
        case (w168) {
          frame 0, Default {
            call "CMD_Iteration.gvi"(VISA_IN=w162, ARRAY_IN=["@DO 51 1#", "@DO 52 1#", "@DO 53 0#"], ERROR_IN=w172) -> (VISA Answer=w175, ERROR_OUT=w173)
            w174 = 0.1
          }
          frame 1 {
            call "CMD_Iteration.gvi"(VISA_IN=w162, ARRAY_IN=["@DO 51 1#", "@DO 52 1#", "@DO 53 1#"], ERROR_IN=w172) -> (VISA Answer=w175, ERROR_OUT=w173)
            w174 = 1
          }
          frame 2 {
            call "CMD_Iteration.gvi"(VISA_IN=w162, ARRAY_IN=["@DO 51 1#", "@DO 52 0#", "@DO 53 1#"], ERROR_IN=w172) -> (VISA Answer=w175, ERROR_OUT=w173)
            w174 = 0.5
          }
          frame 3 {
            # Div x0.25 works with 2 relay
            call "CMD_Iteration.gvi"(VISA_IN=w162, ARRAY_IN=["@DO 51 0#\n"], ERROR_IN=w172) -> (VISA Answer=w175, ERROR_OUT=w173)
            w174 = 0.25
          }
        }
        $"Voltage coeff" <- w174
        $"VISA Answer_2" <- w175
        # Current Range
        case (w171) {
          frame 0, Default {
            call "CMD_Iteration.gvi"(VISA_IN=w162, ARRAY_IN=["@DO 50 0#"], ERROR_IN=w173) -> (ERROR_OUT=w40)
            w176 = 0.1
          }
          frame 1 {
            call "CMD_Iteration.gvi"(VISA_IN=w162, ARRAY_IN=["@DO 50 1#"], ERROR_IN=w173) -> (ERROR_OUT=w40)
            w176 = 1
          }
        }
        $"Current coeff" <- w176
        w41 = s3
        w42 = default
      }
      frame "Reset CVM" {
        Property Node(instance in=s4) -> ("VISA Resource"=w177, instance out=w43)
        # VOLTAGE RANGE
        # @DO 51 0#
        # @DO 52 0#
        # @DO 53 0#
        # CURRENT RANGE
        # @DO 50 1#
        call "CMD_Iteration.gvi"(VISA_IN=w177, ARRAY_IN=["@DO 51 1#", "@DO 52 1#", "@DO 53 1#"], ERROR_IN=w39) -> (VISA_OUT=w178, ERROR_OUT=w179)
        call "CMD_Iteration.gvi"(VISA_IN=w178, ARRAY_IN=["@DO 50 1#"], ERROR_IN=w179) -> (ERROR_OUT=w40)
        $"Voltage coeff" <- 1
        $"Current coeff" <- 1
        w41 = s3
        w42 = default
      }
      frame "VAC" {
        w180 = ["0", "1,", "10,", "20,10,", "50,", "50,20,", "100,", "100,40,10,", "200,100,", "500,100,", "1000,", "2000,", "2000,1000,", "4000,", "4000,1000,", "4000,2000,", "4000,2000,1000,", "4000,2000,1000,500,400,100,"]
        Array Size(array=w180) -> (size(s)=w181)
        Is Less Or Equal(x=$"VAC Load Counter", y=w181) -> w182
        Property Node(instance in=s4) -> ("VISA Resource"=w183, "Physical Channel"=w184, instance out=w43)
        Variant To Data(type=timestamp 1904-01-01T00:00:00Z, variant=w38) -> (data=w185)
        Get Current Time() -> (current time=w186)
        Timestamp Subtract(x=w186, y=w185) -> w187
        Is Greater Or Equal(x=w187, y=5) -> w188
        Logical And(w188, w182) -> w189
        call "DAQmx Read (Analog 2D DBL NChan NSamp).gvi"(task in=w184, number of samples per channel=1) -> (data=w190)
        Array Index(array=w190) -> (out0[1, 0]=w191)
        Multiply(w191, 4) -> w192
        Feedback Node(input=w193) -> w194
        Build Array(w194, w192) -> w193
        Array Index(array=w190) -> (out0[0, 0]=w195)
        Divide(x=w195, y=70) -> w196
        Multiply(w196, 1000) -> w197
        Feedback Node(input=w198) -> w199
        Build Array(w199, w197) -> w198
        Build Cluster(w193, w198) -> w200
        case (w189) {
          frame False, Default {
            w201 = w39
            w202 = w185
            w203 = $"VAC Load Counter"
          }
          frame True {
            Get Current Time() -> (current time=w202)
            # Disconnect ALL load
            Array Index(array=w180) -> (out0[$"VAC Load Counter"]=w204)
            w205 = ["@DO 42 1#", "@DO 34 0#", "@DO 35 0#", "@DO 36 0#", "@DO 37 0#", "@DO 38 0#", "@DO 39 0#", "@DO 40 0#", "@DO 41 0#", "@DO 43 0#", "@DO 44 0#", "@DO 45 0#", "@DO 46 0#", "@DO 47 0#", "@DO 48 0#", "@DO 49 0#"]
            call "CMD_Iteration.gvi"(VISA_IN=w183, ARRAY_IN=w205, ERROR_IN=w39) -> (ERROR_OUT=w206)
            s6 = w204  # shift register
            while {
              Match Pattern(regular expression=",", string=s6) -> (after substring=w207, before substring=w208)
              case (w208) {
                frame "1", Default {
                  call "Read_Write_VISA.gvi"(VISA_IN=w183, CMD="@DO 43 1#", ERROR_IN=w206) -> (ERROR_OUT=w209)
                }
                frame "2" {
                  call "Read_Write_VISA.gvi"(VISA_IN=w183, CMD="@DO 44 1#", ERROR_IN=w206) -> (ERROR_OUT=w209)
                }
                frame "3" {
                  call "Read_Write_VISA.gvi"(VISA_IN=w183, CMD="@DO 45 1#", ERROR_IN=w206) -> (ERROR_OUT=w209)
                }
                frame "5" {
                  call "Read_Write_VISA.gvi"(VISA_IN=w183, CMD="@DO 46 1#", ERROR_IN=w206) -> (ERROR_OUT=w209)
                }
                frame "10" {
                  call "Read_Write_VISA.gvi"(VISA_IN=w183, CMD="@DO 47 1#", ERROR_IN=w206) -> (ERROR_OUT=w209)
                }
                frame "20" {
                  call "Read_Write_VISA.gvi"(VISA_IN=w183, CMD="@DO 48 1#", ERROR_IN=w206) -> (ERROR_OUT=w209)
                }
                frame "40" {
                  call "Read_Write_VISA.gvi"(VISA_IN=w183, CMD="@DO 49 1#", ERROR_IN=w206) -> (ERROR_OUT=w209)
                }
                frame "50" {
                  call "Read_Write_VISA.gvi"(VISA_IN=w183, CMD="@DO 34 1#", ERROR_IN=w206) -> (ERROR_OUT=w209)
                }
                frame "100" {
                  call "Read_Write_VISA.gvi"(VISA_IN=w183, CMD="@DO 35 1#", ERROR_IN=w206) -> (ERROR_OUT=w209)
                }
                frame "200" {
                  call "Read_Write_VISA.gvi"(VISA_IN=w183, CMD="@DO 36 1#", ERROR_IN=w206) -> (ERROR_OUT=w209)
                }
                frame "400" {
                  call "Read_Write_VISA.gvi"(VISA_IN=w183, CMD="@DO 37 1#", ERROR_IN=w206) -> (ERROR_OUT=w209)
                }
                frame "500" {
                  call "Read_Write_VISA.gvi"(VISA_IN=w183, CMD="@DO 38 1#", ERROR_IN=w206) -> (ERROR_OUT=w209)
                }
                frame "1000" {
                  call "Read_Write_VISA.gvi"(VISA_IN=w183, CMD="@DO 39 1#", ERROR_IN=w206) -> (ERROR_OUT=w209)
                }
                frame "2000" {
                  call "Read_Write_VISA.gvi"(VISA_IN=w183, CMD="@DO 40 1#", ERROR_IN=w206) -> (ERROR_OUT=w209)
                }
                frame "4000" {
                  call "Read_Write_VISA.gvi"(VISA_IN=w183, CMD="@DO 41 1#", ERROR_IN=w206) -> (ERROR_OUT=w209)
                }
                frame "0" {
                  # Для измерения тока К.З.
                  # Схема сопротивления
                  # 1 Ом + 1 Ом токовый резистор
                  w209 = w206
                }
              }
              Is Empty String Or Path(string/path=w207) -> w210
              next s6 = w207
              stop if w210
            }
            call "Read_Write_VISA.gvi"(VISA_IN=w183, CMD="@DO 42 0#", ERROR_IN=w209) -> (ERROR_OUT=w201)
            Increment(x=$"VAC Load Counter") -> w203
            $VAC <- w200
          }
        }
        call "Enqueue Message (Single).gvi"(message queue in=w36, message="Watchdog", error in=w201) -> (error out=w211)
        case (w182) {
          frame False, Default {
            call "Enqueue Message (Single).gvi"(message queue in=w36, message="Reset Resistance", error in=w211) -> (error out=w40)
          }
          frame True {
            call "Enqueue Message (Single).gvi"(message queue in=w36, message="VAC", message data=w202, error in=w211) -> (error out=w40)
          }
        }
        $"VAC Load Counter" <- w203
        w41 = s3
        w42 = default
      }
      frame "Optic Filter Config" {
        Property Node(instance in=s4) -> ("VISA Resource"=w212, instance out=w43)
        Variant To Data(error in (no error)=w39, type=string "", variant=w38) -> (data=w213, error out=w214)
        case (w213) {
          frame "None", Default {
            w215 = ["@SERV 3 90#", "@SERV 4 0#"]
          }
          frame "Filter 1" {
            w215 = ["@SERV 3 90#", "@SERV 4 0#", "@SERV 3 0#"]
          }
          frame "Filter 2" {
            w215 = ["@SERV 3 90#", "@SERV 4 0#", "@SERV 4 90#"]
          }
        }
        call "CMD_Iteration.gvi"(VISA_IN=w212, ARRAY_IN=w215, ERROR_IN=w214) -> (ERROR_OUT=w40)
        w41 = s3
        w42 = default
      }
      frame "Fans Control" {
        Property Node(instance in=s4) -> ("VISA Resource"=w216, instance out=w43)
        Variant To Data(error in (no error)=w39, type=string "", variant=w38) -> (data=w217, error out=w218)
        case (w217) {
          frame "Turn All Off", Default {
            w219 = ["@DO 11 0#", "@DO 12 0#"]
          }
          frame "Turn All On" {
            w219 = ["@DO 11 1#", "@DO 12 1#"]
          }
          frame "Turn 50 On" {
            w219 = ["@PWM 11 127#", "@PWM 12 127#"]
          }
        }
        call "CMD_Iteration.gvi"(VISA_IN=w216, ARRAY_IN=w219, ERROR_IN=w218) -> (ERROR_OUT=w40)
        w41 = s3
        w42 = default
      }
      frame "Heat Config" {
        Property Node(instance in=s4) -> ("VISA Resource"=w220, instance out=w43)
        Variant To Data(error in (no error)=w39, type=string "", variant=w38) -> (data=w221, error out=w222)
        case (w221) {
          frame "No Heat", Default {
            w223 = ["@DO 9 0#"]
          }
          frame "50 Heat" {
            w223 = ["@PWM 9 125#"]
          }
          frame "100 Heat" {
            w223 = ["@DO 9 1#"]
          }
        }
        call "CMD_Iteration.gvi"(VISA_IN=w220, ARRAY_IN=w223, ERROR_IN=w222) -> (ERROR_OUT=w40)
        w41 = s3
        w42 = default
      }
      frame "Set PV Angle" {
        Property Node(instance in=s4) -> ("VISA Resource"=w224, instance out=w43)
        Variant To Data(error in (no error)=w39, type=u32 0, variant=w38) -> (data=w225, error out=w226)
        # Set angle limits for PV panels
        In Range And Coerce(lower limit=0, upper limit=180, x=w225) -> (coerced(x)=w227)
        Number To Decimal String(number=w227) -> (decimal integer string=w228)
        Concatenate Strings("@SERV 13 ", w228, " #") -> w229
        call "Read_Write_VISA.gvi"(VISA_IN=w224, CMD=w229, ERROR_IN=w226) -> (ERROR_OUT=w40)
        w41 = s3
        w42 = default
      }
      frame "Brightness Config" {
        Property Node(instance in=s4) -> ("VISA Resource"=w230, instance out=w43)
        Variant To Data(error in (no error)=w39, type=u32 0, variant=w38) -> (data=w231, error out=w232)
        # Set brightness limits
        In Range And Coerce(lower limit=0, upper limit=100, x=w231) -> (coerced(x)=w233)
        Number To Decimal String(number=w233) -> (decimal integer string=w234)
        Concatenate Strings("@DIM 6 ", w234, "#") -> w235
        call "Read_Write_VISA.gvi"(VISA_IN=w230, CMD=w235, ERROR_IN=w232) -> (ERROR_OUT=w40)
        w41 = s3
        w42 = default
      }
      frame "IR Thermometer" {
        Property Node(instance in=s4) -> ("VISA Resource"=w236, instance out=w43)
        Variant To Data(error in (no error)=w39, type=string "", variant=w38) -> (data=w237, error out=w238)
        case (w237) {
          frame "None", Default {
            w239 = "@SERV 5 0#"
          }
          frame "Panel 1" {
            w239 = "@SERV 5 50#"
          }
          frame "Panel 2" {
            w239 = "@SERV 5 90#"
          }
          frame "Panel 3" {
            w239 = "@SERV 5 120#"
          }
          frame "Panel 4" {
            w239 = "@SERV 5 150#"
          }
        }
        call "Read_Write_VISA.gvi"(VISA_IN=w236, CMD=w239, ERROR_IN=w238) -> (ERROR_OUT=w40)
        w41 = s3
        w42 = default
      }
      frame "Set Resistance" {
        Property Node(instance in=s4) -> ("VISA Resource"=w240, instance out=w43)
        Variant To Data(error in (no error)=w39, type=string "", variant=w38) -> (data=w241, error out=w242)
        # Disconnect ALL load
        w243 = ["@DO 42 1#", "@DO 34 0#", "@DO 35 0#", "@DO 36 0#", "@DO 37 0#", "@DO 38 0#", "@DO 39 0#", "@DO 40 0#", "@DO 41 0#", "@DO 43 0#", "@DO 44 0#", "@DO 45 0#", "@DO 46 0#", "@DO 47 0#", "@DO 48 0#", "@DO 49 0#"]
        call "CMD_Iteration.gvi"(VISA_IN=w240, ARRAY_IN=w243, ERROR_IN=w242) -> (VISA_OUT=w244, ERROR_OUT=w245)
        s7 = w241  # shift register
        while {
          Match Pattern(regular expression=";", string=s7) -> (after substring=w246, before substring=w247)
          s8 = w247  # shift register
          while {
            Match Pattern(regular expression=",", string=s8) -> (after substring=w248, before substring=w249)
            case (w249) {
              frame "1", Default {
                call "Read_Write_VISA.gvi"(VISA_IN=w244, CMD="@DO 43 1#", ERROR_IN=w245) -> (ERROR_OUT=w250)
              }
              frame "2" {
                call "Read_Write_VISA.gvi"(VISA_IN=w244, CMD="@DO 44 1#", ERROR_IN=w245) -> (ERROR_OUT=w250)
              }
              frame "3" {
                call "Read_Write_VISA.gvi"(VISA_IN=w244, CMD="@DO 45 1#", ERROR_IN=w245) -> (ERROR_OUT=w250)
              }
              frame "5" {
                call "Read_Write_VISA.gvi"(VISA_IN=w244, CMD="@DO 46 1#", ERROR_IN=w245) -> (ERROR_OUT=w250)
              }
              frame "10" {
                call "Read_Write_VISA.gvi"(VISA_IN=w244, CMD="@DO 47 1#", ERROR_IN=w245) -> (ERROR_OUT=w250)
              }
              frame "20" {
                call "Read_Write_VISA.gvi"(VISA_IN=w244, CMD="@DO 48 1#", ERROR_IN=w245) -> (ERROR_OUT=w250)
              }
              frame "40" {
                call "Read_Write_VISA.gvi"(VISA_IN=w244, CMD="@DO 49 1#", ERROR_IN=w245) -> (ERROR_OUT=w250)
              }
              frame "50" {
                call "Read_Write_VISA.gvi"(VISA_IN=w244, CMD="@DO 34 1#", ERROR_IN=w245) -> (ERROR_OUT=w250)
              }
              frame "100" {
                call "Read_Write_VISA.gvi"(VISA_IN=w244, CMD="@DO 35 1#", ERROR_IN=w245) -> (ERROR_OUT=w250)
              }
              frame "200" {
                call "Read_Write_VISA.gvi"(VISA_IN=w244, CMD="@DO 36 1#", ERROR_IN=w245) -> (ERROR_OUT=w250)
              }
              frame "400" {
                call "Read_Write_VISA.gvi"(VISA_IN=w244, CMD="@DO 37 1#", ERROR_IN=w245) -> (ERROR_OUT=w250)
              }
              frame "500" {
                call "Read_Write_VISA.gvi"(VISA_IN=w244, CMD="@DO 38 1#", ERROR_IN=w245) -> (ERROR_OUT=w250)
              }
              frame "1000" {
                call "Read_Write_VISA.gvi"(VISA_IN=w244, CMD="@DO 39 1#", ERROR_IN=w245) -> (ERROR_OUT=w250)
              }
              frame "2000" {
                call "Read_Write_VISA.gvi"(VISA_IN=w244, CMD="@DO 40 1#", ERROR_IN=w245) -> (ERROR_OUT=w250)
              }
              frame "4000" {
                call "Read_Write_VISA.gvi"(VISA_IN=w244, CMD="@DO 41 1#", ERROR_IN=w245) -> (ERROR_OUT=w250)
              }
              frame "0" {
                # Для измерения тока К.З.
                # Схема сопротивления
                # 1 Ом + 1 Ом токовый резистор
                w250 = w245
              }
            }
            Is Empty String Or Path(string/path=w248) -> w251
            next s8 = w248
            stop if w251
          }
          Is Empty String Or Path(string/path=w246) -> w252
          next s7 = w246
          stop if w252
        }
        # Connect Load
        call "Read_Write_VISA.gvi"(VISA_IN=w240, CMD="@DO 42 0#", ERROR_IN=w250) -> (ERROR_OUT=w40)
        w41 = s3
        w42 = default
      }
      frame "Reset Resistance" {
        Property Node(instance in=s4) -> ("VISA Resource"=w253, instance out=w43)
        # Размыкаются всё реле, сопротивление- бесконечность
        w254 = ["@DO 42 1#", "@DO 34 1#", "@DO 35 1#", "@DO 36 1#", "@DO 37 1#", "@DO 38 1#", "@DO 39 1#", "@DO 40 1#", "@DO 41 1#", "@DO 43 1#", "@DO 44 1#", "@DO 45 1#", "@DO 46 1#", "@DO 47 1#", "@DO 48 1#", "@DO 49 1#"]
        # Сопротивление в начальное положение
        call "CMD_Iteration.gvi"(VISA_IN=w253, ARRAY_IN=w254, ERROR_IN=w39) -> (ERROR_OUT=w40)
        w41 = s3
        w42 = default
      }
      frame "Error" {
        Variant To Data(error in (no error)=w39, type=no error, variant=w38) -> (data=w255, error out=w40)
        # #CodeRecommended - If you ever change the name of this "Error" message, you'll need to update the name in the Check Loop Error.vi as well.
        call "Display Error.gvi"(error in=w255)
        w41 = s3
        w42 = default
        w43 = s4
      }
      frame "Exit" {
        Generate User Event(event data=TRUE, user event=w25) -> (error out=w256)
        Release Queue(error in=w39, queue=w36) -> (error out=w257)
        Property Node(instance in=s4) -> ("VISA Resource"=w258, "Physical Channel"=w259)
        call "DAQmx Stop Task.gvi"(task in=w259) -> (error out=w260)
        call "Close (Instr).gvi"(session in=w258, error in=w260) -> (error out=w261)
        Merge Errors(w261, w256, w257) -> (error out=w40)
        w41 = s3
        w42 = TRUE
        w43 = default
      }
      frame Default {
        w262 = "The invalid message string \"%s\" was received in the Message Handling Loop."
        Format Into String(formatString=w262, w37) -> w263
        call "Build Error Cluster.gvi"(code=1, description=w263) -> (error out=w40)
        w41 = s3
        w42 = default
        w43 = s4
      }
    }
    call "Error Handler - Message Handling Loop.gvi"(message queue in=w36, error in=w40) -> (dup error in=w264)
    $Output <- w40
    next s3 = w41
    next s4 = w43
    stop if w42
  }
  $"Server URL" <- "https://api.systemlinkcloud.com/"
  $"Exit 2" <- FALSE
  $SendArrayDoubleToCloud <- "Send Measured Data To Cloud"
  $SendStringToCloud <- "Send String To Cloud"
  $SendDoubleToCloud <- "Send Double To Cloud"
  w265 = bool FALSE  # Stop Event
  Create User Event[EventName="Stop Event"](user event data type=w265) -> (error out=w266, user event out=w267)
  call "Create All Message Queues.gvi"(error in=w266) -> (message queues=w268, error out=w269)
  Property Node(instance in=w268) -> ("UI"=w270)
  s9 = "UI Data.gtype" {all zero or empty}  # shift register
  while {
    call "Dequeue Message.gvi"(message queue in=w270, error in=w269) -> (message queue out=w271, message=w272, message data=w273, error out=w274)
    # s9: Data
    # w267: Stop Event
    case (w272) ignore case {  # Message Cases
      frame "Initialize" {
        Property Node(instance in=s9, "String"=w272) -> (instance out=w276)
        call "Enqueue Message (Single).gvi"(message queue in=w271, message="Update Display", message data=w272, error in=w274) -> (message queue out=w278, error out=w279)
        # Bundle a sample string value.
        call "Enqueue Message (Single).gvi"(message queue in=w278, message=$SendArrayDoubleToCloud, error in=w279) -> (error out=w275)
        Property Node(instance in=reference to "MV-Panel Configuration", "ValueSignaling"="none")
        Property Node(instance in=reference to "PV-Panel Cofiguration", "ValueSignaling"="none")
        Property Node(instance in=reference to "PV-Temperature, ºC", "ValueSignaling"=0)
        Property Node(instance in=reference to "MV-Heating", "ValueSignaling"="none")
        Property Node(instance in=reference to "PV-Heating", "ValueSignaling"="none")
        Property Node(instance in=reference to "MV-Cooling", "ValueSignaling"="none")
        Property Node(instance in=reference to "PV-LightIntensity, W/m2", "ValueSignaling"=0)
        Property Node(instance in=reference to "PV-Cooling", "ValueSignaling"="none")
        Property Node(instance in=reference to "MV-Light Power", "ValueSignaling"="none")
        Property Node(instance in=reference to "PV-Panel Tilt Angle, º", "ValueSignaling"=0)
        Property Node(instance in=reference to "PV-Optical Filter", "ValueSignaling"="none")
        Property Node(instance in=reference to "MV-Optical Filter", "ValueSignaling"="none")
        Property Node(instance in=reference to "PV-LoadR4", "ValueSignaling"="none")
        Property Node(instance in=reference to "PV-Voltage, V", "ValueSignaling"=0)
        Property Node(instance in=reference to "MV-Panel Tilt Angle", "ValueSignaling"="none")
        Property Node(instance in=reference to "PV-LoadR3", "ValueSignaling"="none")
        Property Node(instance in=reference to "PV-Current, mA", "ValueSignaling"=0)
        Property Node(instance in=reference to "MV-LoadR1", "ValueSignaling"="none")
        Property Node(instance in=reference to "PV-LoadR2", "ValueSignaling"="none")
        Property Node(instance in=reference to "PV-LoadR,Ohm", "ValueSignaling"=0)
        Property Node(instance in=reference to "MV-LoadR2", "ValueSignaling"="none")
        Property Node(instance in=reference to "PV-LoadR1", "ValueSignaling"="none")
        Property Node(instance in=reference to "MV-LoadR3", "ValueSignaling"="none")
        Property Node(instance in=reference to "MV-LoadR4", "ValueSignaling"="none")
        w277 = default
      }
      frame "Something" {
        # #CodeNeeded - Perform whatever actions correspond to the "Something" message.
        # Send string to "Update Display" message
        call "Enqueue Message (Single).gvi"(message queue in=w271, message="Update Display", message data="\"Do Something\" button pressed", error in=w274) -> (error out=w275)
        w276 = s9
        w277 = default
      }
      frame "Something Else" {
        # #CodeNeeded - Perform whatever actions correspond to the "Something Else" message.
        # Send string to "Update Display" message
        call "Enqueue Message (Single).gvi"(message queue in=w271, message="Update Display", message data="\"Do Something Else\" button pressed", error in=w274) -> (error out=w275)
        w276 = s9
        w277 = default
      }
      frame "Update Display" {
        # #CodeRecommended - If you wish to decouple the Message Handling Loop from your user interface, consider creating User Events (like the "Stop" event in this VI) to message the Event Handling Loop whenever the user interface needs updating.
        Variant To Data(error in (no error)=w274, type=string "", variant=w273) -> (data=w280, error out=w275)
        $"Status of Send to SystemLink Cycle" <- w280
        w276 = s9
        w277 = default
      }
      frame "Error" {
        Variant To Data(error in (no error)=w274, type=no error, variant=w273) -> (data=w281, error out=w275)
        # #CodeRecommended - Consider creating a system for logging errors in some way. These errors are for notification purposes only. Handling of specific errors should be performed in the message frames that generated the error.
        # #CodeRecommended - If you ever change the name of this "Error" message, you'll need to update the name in the Check Loop Error.vi as well.
        call "Display Error.gvi"(error in=w281)
        w276 = s9
        w277 = default
      }
      frame "---Copy This Frame---" {
        Merge Errors(w274) -> (error out=w275)
        w276 = s9
        w277 = default
      }
      frame "Exit" {
        # Release the message queue reference
        Release Queue(error in=w274, queue=w271) -> (error out=w282)
        # #CodeNeeded - Add any required cleanup code here. Note that if 'Exit' was called as a result of an error, an error dialog will be displayed. Add any custom error handling for an 'Exit' condition here as well.
        Generate User Event(event data=TRUE, user event=w267) -> (error out=w283)
        Merge Errors(w283, w282) -> (error out=w275)
        # Stop the VI
        $"Exit 2" <- TRUE
        w276 = s9
        w277 = TRUE
      }
      frame Default {
        w284 = "The invalid message string \"%s\" was received in the Message Handling Loop."
        Format Into String(formatString=w284, w272) -> w285
        call "Build Error Cluster.gvi"(code=1, description=w285) -> (error out=w275)
        w276 = s9
        w277 = default
      }
      frame "Send Double To Cloud" {
        Property Node(instance in=s9, "String"=w272) -> (instance out=w276)
        call "Open Configuration API Key.gvi"(server url=$"Server URL", api key=$"API Key", error in=w274) -> (configuration=w286)
        Variant To Data(type=string[] [], variant=w273) -> (data=w287)
        Array Index(array=w287) -> (out0[0]=w288, out1[1]=w289)
        Floating Point String To Number(string=w289) -> (number=w290)
        Build Array(w288) -> w291
        call "Query Tags.gvi"(paths=w291, configuration=w286) -> (tags=w292, error out=w293)
        Array Index(array=w292) -> (out0[_]=w294)
        Property Node(instance in=w294) -> ("Path"=w295, "Datatype"=w296)
        call "Open Tag.gvi"(path=w295, data type=w296, error in=w293, configuration=w286) -> (tag=w297, error out=w298)
        call "Write Tag (DBL).gvi"(tag in=w297, value=w290, error in=w298) -> (tag out=w299, error out=w300)
        call "Close Tag (Single).gvi"(tag=w299, error in=w300) -> (error out=w301)
        call "Close Configuration.gvi"(configuration=w286, error in=w301) -> (error out=w275)
        call "Enqueue Message (Single).gvi"(message queue in=w271, message="Update Display", message data=w272)
        w277 = default
      }
      frame "Send Measured Data To Cloud" {
        Property Node(instance in=s9, "String"=w272) -> (instance out=w276)
        call "Enqueue Message (Single).gvi"(message queue in=w271, message="Update Display", message data=w272, error in=w274) -> (message queue out=w302, error out=w303)
        call "Enqueue Message (Single).gvi"(message queue in=w302, message=$SendArrayDoubleToCloud, error in=w303) -> (error out=w304)
        call "Open Configuration API Key.gvi"(server url=$"Server URL", api key=$"API Key", error in=w304) -> (configuration=w305, error out=w306)
        w307 = ["PV-Current", "PV-Voltage", "PV-Temperature", "PV-LigthtIntensity"]
        call "Query Tags.gvi"(paths=w307, error in=w306, configuration=w305) -> (tags=w308, error out=w309)
        for {
          w310 = each element of w308
          w311 = each element of $MeasuredData
          Property Node(instance in=w310) -> ("Path"=w312, "Datatype"=w313)
          call "Open Tag.gvi"(path=w312, data type=w313, error in=w309, configuration=w305) -> (tag=w314, error out=w315)
          call "Write Tag (DBL).gvi"(tag in=w314, value=w311, error in=w315) -> (error out=w316)
        }
        for {
          w317 = each element of w308
          call "Close Tag (Single).gvi"(tag=w317, error in=w316) -> (error out=w318)
        }
        call "Close Configuration.gvi"(configuration=w305, error in=w318) -> (error out=w275)
        w277 = default
      }
      frame "Send String To Cloud" {
        Property Node(instance in=s9, "String"=w272) -> (instance out=w276)
        call "Open Configuration API Key.gvi"(server url=$"Server URL", api key=$"API Key", error in=w274) -> (configuration=w319, error out=w320)
        Variant To Data(type=string[] [], variant=w273) -> (data=w321)
        Array Index(array=w321) -> (out0[0]=w322, out1[1]=w323)
        Build Array(w322) -> w324
        call "Query Tags.gvi"(paths=w324, configuration=w319) -> (tags=w325)
        Array Index(array=w325) -> (out0[_]=w326)
        Property Node(instance in=w326) -> ("Path"=w327, "Datatype"=w328)
        call "Open Tag.gvi"(path=w327, data type=w328, error in=w320, configuration=w319) -> (tag=w329, error out=w330)
        call "Write Tag (String).gvi"(tag in=w329, value=w323, error in=w330) -> (tag out=w331, error out=w332)
        call "Close Tag (Single).gvi"(tag=w331, error in=w332) -> (error out=w333)
        call "Close Configuration.gvi"(configuration=w319, error in=w333) -> (error out=w275)
        call "Enqueue Message (Single).gvi"(message queue in=w271, message="Update Display", message data=w272)
        w277 = default
      }
    }
    call "Error Handler - Message Handling Loop.gvi"(message queue in=w271, error in=w275) -> (dup error in=w334)
    next s9 = w276
    stop if w277
  }
  Register For Events("Stop Event"=w267) -> (event registration refnum out=w335)
  s10 = w335  # shift register
  while {
    event (dynamic events = s10) {
      on "Do Something" Value changed {
        # #CodeNeeded - Send the appropriate message for this user interface event.
        call "Enqueue Message (Single).gvi"(message queue in=w270, message="Something") -> (message queue out=w338, error out=w337)
        w336 = default
      }
      on "Do Something Else" Value changed {
        # #CodeNeeded - Send the appropriate message for this user interface event.
        call "Enqueue Message (Single).gvi"(message queue in=w270, message="Something Else") -> (message queue out=w338, error out=w337)
        w336 = default
      }
      on "Exit" Value changed {
        call "Enqueue Message (Single).gvi"(priority message=TRUE, message queue in=w270, message="Exit") -> (message queue out=w338, error out=w337)
        w336 = default
      }
      on dynamic event 0 {
        # The Message Handling Loop processed an "Exit" message, which fired this event to stop the Event Handling Loop.
        $"Status of Send to SystemLink Cycle" <- "\"Exit\" button pressed"
        w336 = TRUE
        w337 = default
        w338 = w270
      }
      on "Window" Close? {
        call "Enqueue Message (Single).gvi"(priority message=TRUE, message queue in=w270, message="Exit") -> (message queue out=w338)
        Event Filter("Discard?"=TRUE)
        w336 = default
        w337 = default
      }
      on "PV-Current, mA" Value changed {
        Event Data() -> ("New Value"=w339)
        Number To Fractional String(number=w339) -> (F-format string=w340)
        Build Array("PV-Current", w340) -> w341
        call "Enqueue Message (Single).gvi"(message queue in=w270, message=$SendDoubleToCloud, message data=w341) -> (message queue out=w338)
        w336 = default
        w337 = default
      }
      on "PV-LoadR,Ohm" Value changed {
        Event Data() -> ("New Value"=w342)
        Number To Fractional String(number=w342) -> (F-format string=w343)
        Build Array("PV-LoadR", w343) -> w344
        call "Enqueue Message (Single).gvi"(message queue in=w270, message=$SendDoubleToCloud, message data=w344) -> (message queue out=w338)
        w336 = default
        w337 = default
      }
      on "PV-Voltage, V" Value changed {
        Event Data() -> ("New Value"=w345)
        Number To Fractional String(number=w345) -> (F-format string=w346)
        Build Array("PV-Voltage", w346) -> w347
        call "Enqueue Message (Single).gvi"(message queue in=w270, message=$SendDoubleToCloud, message data=w347) -> (message queue out=w338)
        w336 = default
        w337 = default
      }
      on "PV-Temperature, ºC" Value changed {
        Event Data() -> ("New Value"=w348)
        Number To Fractional String(number=w348) -> (F-format string=w349)
        Build Array("PV-Temperature", w349) -> w350
        call "Enqueue Message (Single).gvi"(message queue in=w270, message=$SendDoubleToCloud, message data=w350) -> (message queue out=w338)
        w336 = default
        w337 = default
      }
      on "PV-LightIntensity, W/m2" Value changed {
        Event Data() -> ("New Value"=w351)
        Number To Fractional String(number=w351) -> (F-format string=w352)
        Build Array("PV-LigthtIntensity", w352) -> w353
        call "Enqueue Message (Single).gvi"(message queue in=w270, message=$SendDoubleToCloud, message data=w353) -> (message queue out=w338)
        w336 = default
        w337 = default
      }
      on "PV-Panel Tilt Angle, º" Value changed {
        Event Data() -> ("New Value"=w354)
        Number To Fractional String(number=w354) -> (F-format string=w355)
        Build Array("PV-Panel Tilt Angle", w355) -> w356
        call "Enqueue Message (Single).gvi"(message queue in=w270, message=$SendDoubleToCloud, message data=w356) -> (message queue out=w338)
        w336 = default
        w337 = default
      }
      on "PV-Panel Cofiguration" Value changed {
        Event Data() -> ("New Value"=w357)
        Build Array("PV-Panel Configuration", w357) -> w358
        call "Enqueue Message (Single).gvi"(message queue in=w270, message=$SendStringToCloud, message data=w358) -> (message queue out=w338)
        w336 = default
        w337 = default
      }
      on "PV-Cooling" Value changed {
        Event Data() -> ("New Value"=w359)
        Build Array("PV-Cooling", w359) -> w360
        call "Enqueue Message (Single).gvi"(message queue in=w270, message=$SendStringToCloud, message data=w360) -> (message queue out=w338)
        w336 = default
        w337 = default
      }
      on "PV-Heating" Value changed {
        Event Data() -> ("New Value"=w361)
        Build Array("PV-Heating", w361) -> w362
        call "Enqueue Message (Single).gvi"(message queue in=w270, message=$SendStringToCloud, message data=w362) -> (message queue out=w338)
        w336 = default
        w337 = default
      }
      on "PV-Optical Filter" Value changed {
        Event Data() -> ("New Value"=w363)
        Build Array("PV-Optical Filter", w363) -> w364
        call "Enqueue Message (Single).gvi"(message queue in=w270, message=$SendStringToCloud, message data=w364) -> (message queue out=w338)
        w336 = default
        w337 = default
      }
      on "PV-LoadR1" Value changed {
        Event Data() -> ("New Value"=w365)
        Build Array("PV-LoadR1", w365) -> w366
        call "Enqueue Message (Single).gvi"(message queue in=w270, message=$SendStringToCloud, message data=w366) -> (message queue out=w338)
        w336 = default
        w337 = default
      }
      on "PV-LoadR2" Value changed {
        Event Data() -> ("New Value"=w367)
        Build Array("PV-LoadR2", w367) -> w368
        call "Enqueue Message (Single).gvi"(message queue in=w270, message=$SendStringToCloud, message data=w368) -> (message queue out=w338)
        w336 = default
        w337 = default
      }
      on "PV-LoadR3" Value changed {
        Event Data() -> ("New Value"=w369)
        Build Array("PV-LoadR3", w369) -> w370
        call "Enqueue Message (Single).gvi"(message queue in=w270, message=$SendStringToCloud, message data=w370) -> (message queue out=w338)
        w336 = default
        w337 = default
      }
      on "PV-LoadR4" Value changed {
        Event Data() -> ("New Value"=w371)
        Build Array("PV-LoadR4", w371) -> w372
        call "Enqueue Message (Single).gvi"(message queue in=w270, message=$SendStringToCloud, message data=w372) -> (message queue out=w338)
        w336 = default
        w337 = default
      }
    }
    call "Error Handler - Event Handling Loop.gvi"(message queue in=w338, error in=w337) -> (dup error in=w373)
    stop if w336
  }
  Unregister For Events(error in=w373, event registration refnum=s10) -> (error out=w374)
  Merge Errors(w374, w334) -> (error out=w375)
  Destroy User Event(error in=w375, user event=w267)
  disable {
    frame Enabled { }
    frame Disabled {
      call "Initialize.gvi"(device name="cam0") -> (session out=w376, error out=w377)
      call "Configure Grab.gvi"(session in=w376, error in=w377) -> (session out=w378, error out=w379)
      call "Create Image.gvi"(image name="image_1") -> (new image=w380)
      while {
        call "Grab.gvi"(session in=w378, error in=w379, image in=w380) -> (session out=w381, error out=w382)
        stop if $Stop
      }
      call "Close.gvi"(session=w381, error in=w382)
    }
  }
